# Grasshopper definition amoeba-curve-2d.ghx (Grasshopper 1.0.7)

# 2D Amoeba-like Curve
# https://github.com/runxel/grasshopper-examples
crv = Curve([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])
darc = DeconstructArc(Arc=crv)  # -> BasePlane, Radius, Angle
hull = ConvexHull(Points=darc.BasePlane, Plane=PlaneXY(0, 0, 0))  # -> Hull, HullZ, Indices
visit_the_website = Button()

# ---- group: Sort CCW
item = TreeItem(Tree=crv, Path="{0}", Index=hull.Indices, Wrap=True)

# ----
orib = OpenRepoInBrowser(open=visit_the_website)
area = Area(Geometry=hull.Hull)  # -> Area, Centroid
explode = Explode(Curve=hull.Hull, Recursive=True)  # -> Segments, Vertices
shift = ShiftList(List=item, Shift=1, Wrap=True)
data = Data(item)
entwine = Entwine(Branch00=data, Branch01=shift, FlattenInputs=True)
flip = FlipMatrix(Data=entwine)
# Get the point guide for CircTanTan
ccx = CurveCurve(CurveA=simplify(graft(explode.Segments)), CurveB=simplify(flip))  # -> Points, ParamsA, ParamsB
relitem = RelativeItem(Tree=ccx.Points, Offset="{0;+1}[0]", WrapPaths=False, WrapItems=False)  # -> ItemA, ItemB
ln = Line(StartPoint=relitem.ItemA, EndPoint=relitem.ItemB)
graft = GraftTree(Tree=explode.Segments, IncludeEmptyLists=True, IncludeNullItems=True)
midpt = CurveMiddle(Curve=ln)  # -> simplify(Midpoint)
crv_cp = CurveClosestPoint(Point=midpt, Curve=graft)  # -> Point, Parameter, Distance
pframe = PerpFrame(Curve=graft, Parameter=crv_cp.Parameter)
deplane = DeconstructPlane(Plane=pframe)  # -> Origin, XAxis, YAxis, ZAxis
amp = Amplitude(Vector=deplane.YAxis, Amplitude=Slider(3.646, range=0..13))
move = Move(Geometry=midpt, Motion=amp)  # -> Geometry, Transform
circlett = CircleTanTan(CurveA=graft(data), CurveB=graft(shift), Point=move.Geometry)
merge = Merge(Data1=data, Data2=circlett)  # -> flatten(Result)
shint = ShatterInt(crv=merge)
midpt_2 = CurveMiddle(Curve=shint)
dist = Distance(HullMid=area.Centroid, PointB=midpt_2)  # -> simplify(Distance)
relitem_2 = RelativeItem(Tree=dist, Offset="{0}[+1]", WrapPaths=False, WrapItems=False)  # -> ItemA, ItemB
larger = LargerThan(FirstNumber=relitem_2.ItemA, SecondNumber=relitem_2.ItemB)  # -> LargerThan, OrEqualTo
larger_2 = LargerThan(FirstNumber=relitem_2.ItemB, SecondNumber=relitem_2.ItemA)  # -> LargerThan, OrEqualTo
lng = ListLength(List=crv)
python = GhPythonScript(path_n=lng)  # -> mask; inputs path_n: Int32
# ---------- python: Python ----------
# format mask string for 'split tree' component
# to use literal curly brackets you need to double them in python
split_n = path_n - 1  # (because paths are zero based)
mask = "{{(0 to {})}}".format(split_n)
# ---------- end python ----------
merge_2 = Merge(Data1=larger.LargerThan, Data2=larger_2.LargerThan)
# Selecting the curves to keep
split = SplitTree(Data=merge_2, Masks=flatten(python))  # -> Positive, Negative

# ---- group: simple bool inverse func
expression = Expression(x=split.Negative, Expression="x=False")

# ----
merge_3 = Merge(Data1=split.Positive, Data2=expression)
dispatch = Dispatch(List=shint, DispatchPattern=merge_3)  # -> ListA, ListB
join = JoinCurves(Curves=flatten(dispatch.ListA), Preserve=False)
geo = Geometry(join)
preview = CustomPreview(Geometry=geo, Material=ColourSwatch(SwatchColor=RGB(151, 242, 15)))

# ==== cluster ShatterInt: Shatter multiple curves at their intersections
crv = ClusterInput()

crv_2 = Curve(reparameterize(flatten(crv)))
cx = CurveSelf(Curve=crv_2)  # -> Points, Params
shatter = Shatter(Curve=graft(crv_2), Parameters=cx.Params)
combine = CombineData(Input0=shatter, Input1=graft(crv_2))  # -> flatten(Result), Index

mcx = MultipleCurves(Curves=combine.Result)  # -> Points, IndexA, IndexB, ParamA, ParamB
cset = CreateSet(List=[mcx.IndexA, mcx.IndexB])  # -> Set, Map
lng = ListLength(List=combine.Result)
lng_2 = ListLength(List=[mcx.IndexA, mcx.IndexB])
series = Series(Start=0, Step=1, Count=lng)
series_2 = Series(Start=0, Step=1, Count=lng_2)
int = Integer(series)
path = CreatePath(Indices=graft(series_2))  # -> flatten(Branch)
exdiff = SetDifferenceS(SetA=cset.Set, SetB=int)
replace = ReplaceBranches(Data=simplify(graft([mcx.ParamA, mcx.ParamB])), Search=path, Replace=[mcx.IndexA, mcx.IndexB])
cull_i = CullIndex(List=combine.Result, Indices=exdiff, Wrap=False)
shatter_2 = Shatter(Curve=simplify(graft(cull_i)), Parameters=replace)

S = ClusterOutput(shatter_2)

# ==== cluster OpenRepoInBrowser
open = ClusterInput()
python = GhPythonScript(open=open)
# ---------- python: Python ----------
""" A simple 'open in browser' script """

import webbrowser

url = 'https://github.com/runxel/grasshopper-examples'

if open:
    webbrowser.open(url, new=2)
# ---------- end python ----------
