# Grasshopper definition attractor_1_point.ghx (Grasshopper 1.0.7)

# Attractor I: Point
# https://github.com/runxel/grasshopper-examples
size_rectangle = Slider(50, range=1..50)
division_number = Slider(25, range=1..30)
md_slider = MDSlider(
    SliderMode=0,
    slider_value=Point(0.5869140625, 0.465625856, 0.5),
    x_domain=Domain(0, 50),
    y_domain=Domain(0, 50),
    z_domain=Domain(0, 1))
rectangle = Rectangle(Plane=PlaneXY(0, 0, 0), XSize=size_rectangle, YSize=size_rectangle, Radius=0)  # -> Rectangle, Length
visit_the_website = Button()
surface = Surface(rectangle.Rectangle)

# ---- group: Attractor Point
symsim = SymbolSimple(Style=3, Size=12, Rotation=0, Colour=RGB(3, 217, 255))
symbol = SymbolDisplay(Location=md_slider, Display=symsim)

# ----
orib = OpenRepoInBrowser(open=visit_the_website)
divide_surface = DivideSurface(Surface=surface, UCount=division_number, VCount=division_number)  # -> Points, Normals, Parameters

# ---- group: Distance to Attractor
distance = Distance(PointA=divide_surface.Points, PointB=md_slider)  # -> flatten(Distance)

# ----
circlesize = ControlKnob(Decimals=2, Limit=True, Maximum=20, Minimum=0, Range=1, Value=12.62)
division = Division(A=distance, B=circlesize)
circle = Circle(Plane=flatten(divide_surface.Points), Radius=division)

# ---- group: make it colorful
boundary_surfaces = BoundarySurfaces(Edges=circle)
area = Area(Geometry=circle)  # -> Area, Centroid
bounds = Bounds(Numbers=area.Area)
deconstruct_domain = DeconstructDomain(Domain=bounds)  # -> Start, End
gradient = Gradient(
    LowerLimit=deconstruct_domain.Start,
    UpperLimit=deconstruct_domain.End,
    Parameter=area.Area,
    stops=[0.108: RGB(214, 20, 22), 0.17: RGB(243, 57, 0), 0.296: RGB(241, 253, 111), 0.399: RGB(79, 186, 8), 0.562: RGB(18, 178, 90), 0.708: RGB(1, 192, 229), 0.813: RGB(39, 72, 161), 0.933: RGB(103, 0, 120)])
custom_preview = CustomPreview(Geometry=boundary_surfaces, Shader=gradient)

# ---- group: Show vectors to the Attractor point
vector_2pt = Vector2Pt(PointA=divide_surface.Points, PointB=md_slider, Unitize=True)  # -> Vector, Length
amplitude = ControlKnob(Decimals=2, Limit=True, Maximum=10, Minimum=0, Range=1, Value=6.42)
division_2 = Division(A=distance, B=amplitude)
amplitude_2 = Amplitude(Vector=flatten(vector_2pt.Vector), Amplitude=division_2)
vector_display = VectorDisplay(Anchor=flatten(divide_surface.Points), Vector=amplitude_2)

# ==== cluster OpenRepoInBrowser
open = ClusterInput()
python = GhPythonScript(open=open)
# ---------- python: Python ----------
""" A simple 'open in browser' script """

import webbrowser

url = 'https://github.com/runxel/grasshopper-examples'

if open:
    webbrowser.open(url, new=2)
# ---------- end python ----------
