# Grasshopper definition attractor_2_linear.ghx (Grasshopper 1.0.7)

md_slider = MDSlider(
    SliderMode=0,
    slider_value=Point(0.1890243902, 0.6040396341, 0.5),
    x_domain=Domain(0, 100),
    y_domain=Domain(0, 100),
    z_domain=Domain(0, 1))
md_slider_2 = MDSlider(
    SliderMode=0,
    slider_value=Point(0.04599389797, 0.2339179807, 0.5),
    x_domain=Domain(0, 100),
    y_domain=Domain(0, 100),
    z_domain=Domain(0, 1))
md_slider_3 = MDSlider(
    SliderMode=0,
    slider_value=Point(0.7153205872, 0.5415396341, 0.5),
    x_domain=Domain(0, 100),
    y_domain=Domain(0, 100),
    z_domain=Domain(0, 1))
md_slider_4 = MDSlider(
    SliderMode=0,
    slider_value=Point(0.2774390709, 0, 0.5),
    x_domain=Domain(0, 100),
    y_domain=Domain(0, 100),
    z_domain=Domain(0, 1))

# ----
# Attractor II: Linear
# https://github.com/runxel/grasshopper-examples
size = Slider(2, range=0..4)
cells = Slider(18, range=2..50)
size_attractor_field = Slider(5, range=0..15)
hexagonal = Hexagonal(Plane=PlaneXY(0, 0, 0), Size=size, ExtentX=cells, ExtentY=cells)  # -> Cells, simplify(Points)
visit_the_website = Button()
orib = OpenRepoInBrowser(open=visit_the_website)
division = Division(A=size, B=2)
division_2 = Division(A=size, B=8)
merge = Merge(Data1=md_slider, Data2=md_slider_2, Data3=md_slider_3, Data4=md_slider_4)
nurbs = NurbsCurve(Vertices=merge, Degree=3, Periodic=False)  # -> Curve, Length, Domain
curve = Curve(nurbs.Curve)
preview = CustomPreview(Geometry=curve, Material=ColourSwatch(SwatchColor=RGB(8, 255, 0)))
curve_closest_point = CurveClosestPoint(Point=hexagonal.Points, Curve=curve)  # -> Point, Parameter, Distance
larger = LargerThan(FirstNumber=size_attractor_field, SecondNumber=curve_closest_point.Distance)  # -> LargerThan, OrEqualTo
dispatch = Dispatch(List=hexagonal.Points, DispatchPattern=larger.LargerThan)  # -> ListA, ListB

circle_cnr = CircleCNR(Center=dispatch.ListA, Normal=Vector(0, 0, 1), Radius=division)
circle_cnr_2 = CircleCNR(Center=dispatch.ListB, Normal=Vector(0, 0, 1), Radius=division_2)

# ==== cluster OpenRepoInBrowser
open = ClusterInput()
python = GhPythonScript(open=open)
# ---------- python: Python ----------
""" A simple 'open in browser' script """

import webbrowser

url = 'https://github.com/runxel/grasshopper-examples'

if open:
    webbrowser.open(url, new=2)
# ---------- end python ----------
