# Grasshopper definition attractor_3_deflection.ghx (Grasshopper 1.0.7)

# ---- group: Deflector
# Attractor III: Deflection
# https://github.com/runxel/grasshopper-examples
# "negative attractor point"
pt = Point(Point(36.97213038, -6.356133347, 0))

# ---- group: Line endpoints
pt_2 = Point([Point(7.26595242, 6.160388717, 0), Point(70.32326342, 1.171174711, 0)])

# ----
count_smoothness = Slider(15, range=10..25)
deflection_strength = Slider(2.2, range=0..10)
pline = PolyLine(Vertices=pt_2, Closed=False)
visit_the_website = Button()
divide = DivideCurve(Curve=pline, Count=count_smoothness, Kinks=False)  # -> Points, Tangents, Parameters
vec2pt = Vector2Pt(PointA=pt, PointB=divide.Points, Unitize=False)  # -> Vector, Length
pull = PullPoint(Point=divide.Points, Geometry=pt_2, ClosestOnly=True)  # -> ClosestPoint, Distance
orib = OpenRepoInBrowser(open=visit_the_website)
one_over_x = OneOverX(Value=vec2pt.Length)
multiplication = Multiplication(A=one_over_x, B=pull.Distance)
multiplication_2 = Multiplication(A=multiplication, B=deflection_strength)
amp = Amplitude(Vector=vec2pt.Vector, Amplitude=multiplication_2)

# ---- group: OG crv
dash = DashPattern(Curve=pline, Pattern=Slider(4, range=0..10))  # -> Dashes, Gaps

# ----
move = Move(Geometry=divide.Points, Motion=amp)  # -> Geometry, Transform

symsim = SymbolSimple(Style=3, Size=12, Rotation=0, Colour=RGB(255, 105, 180))
symbol = SymbolDisplay(Location=pt, Display=symsim)

nurbs = NurbsCurve(Vertices=move.Geometry, Degree=3, Periodic=False)  # -> Curve, Length, Domain
vdis = VectorDisplay(Anchor=pt, Vector=amp)

# ==== cluster OpenRepoInBrowser
open = ClusterInput()
python = GhPythonScript(open=open)
# ---------- python: Python ----------
""" A simple 'open in browser' script """

import webbrowser

url = 'https://github.com/runxel/grasshopper-examples'

if open:
    webbrowser.open(url, new=2)
# ---------- end python ----------
