# Grasshopper definition attractor_4_multiple_points.ghx (Grasshopper 1.0.7)

# ---- group: Input
# Attractor IV: Multiple Points
# https://github.com/runxel/grasshopper-examples
number_slider = Slider(85, range=0..100)
trigrid = Triangular(Plane=PlaneXY(0, 0, 0), Size=1, ExtentX=number_slider, ExtentY=Slider(69, range=0..100))  # -> Cells, flatten(Points)
pt = ConstructPoint(XCoordinate=Slider(27, range=0..100), YCoordinate=Slider(19, range=0..100), ZCoordinate=0)
pt_2 = ConstructPoint(XCoordinate=Slider(20, range=0..100), YCoordinate=Slider(28, range=0..100), ZCoordinate=0)
cp = ControlPoints(Curve=trigrid.Cells)  # -> flatten(Points), Weights, Knots
cset = CreateSet(List=cp.Points)  # -> Set, Map
centerpoints = Point(cset.Set)
attractor_2 = Point(pt_2)
attractor_1 = Point(pt)

# ----
visit_the_website = Button()
orib = OpenRepoInBrowser(open=visit_the_website)

# ---- group: Calculate Distance to Attractor 1
centerpoints_2 = Point(centerpoints)
attractor_1_2 = Point(attractor_1)
dist = Distance(PointA=centerpoints_2, PointB=attractor_1_2)
d1 = Number(dist)

# ---- group: Calculate Distance to Attractor 2
centerpoints_3 = Point(centerpoints)
attractor_2_2 = Point(attractor_2)
dist_2 = Distance(PointA=centerpoints_3, PointB=attractor_2_2)
d2 = Number(dist_2)

# ---- group: modify Results
d1_2 = Number(d1)
expression = Expression(x=d1_2, y=Slider(1, range=0..1), s=Slider(2.927, range=0..10), Expression="e^(-(x-y)²/(2*s²))/ ((2*π)^.5*s)")
d1_3 = Number(expression)

d2_2 = Number(d2)
expression_2 = Expression(x=d2_2, y=Slider(0.451, range=0..1), s=Slider(4.603, range=0..10), Expression="1 - e^(-(x-y)²/(2*s²))/ ((2*π)^.5*s)")
d2_3 = Number(expression_2)

# ---- group: Remap values between 0.2 to 0.8
d1_4 = Number(d1_3)
_0_05_to_0_2 = Domain(Domain(0.05, 0.2))
bnd = Bounds(Numbers=d1_4)
remap = RemapNumbers(Value=d1_4, Source=bnd, Target=_0_05_to_0_2)  # -> Mapped, Clipped
remapedd1 = Number(remap.Mapped)

d2_4 = Number(d2_3)
_0_05_to_0_2_2 = Domain(Domain(0.05, 0.2))
bnd_2 = Bounds(Numbers=d2_4)
remap_2 = RemapNumbers(Value=d2_4, Source=bnd_2, Target=_0_05_to_0_2_2)  # -> Mapped, Clipped
remapedd2 = Number(remap_2.Mapped)

# ---- group: Combine Results
remapedd1_2 = Number(remapedd1)
remapedd2_2 = Number(remapedd2)
addition = Addition(A=remapedd1_2, B=remapedd2_2)
V = Number(addition)

# ---- group: compute similarity
remapedv = Number(V)
cset_2 = CreateSet(List=remapedv)  # -> Set, Map
lng = ListLength(List=cset_2.Set)
number_of_different_sized_circles = Panel(lng)
different_sizes = Panel(cset_2.Set)

# ---- group: Simple Rounding
factor = Slider(10, range=10..1000)
remapedv_2 = Number(V)
expression_3 = Expression(rV=remapedv_2, f=factor, Expression="round(rV*f)/f")
cset_3 = CreateSet(List=expression_3)  # -> Set, Map
lng_2 = ListLength(List=cset_3.Set)
number_of_different_sized_circles_2 = Panel(lng_2)
different_sizes_2 = Panel(cset_3.Set)
roundedvalues = Number(expression_3)

# ---- group: Specific Sizes Simple
remapedv_3 = Number(V)
wantedsizes = Panel("""0.1
0.2
0.3
0.3
0.3
0.4""")
cset_4 = CreateSet(List=remapedv_3)  # -> Set, Map
num = Number(wantedsizes)
sort = SortList(Keys=cset_4.Set)  # -> Keys, ValuesA
sort_2 = SortList(Keys=num)  # -> Keys, ValuesA
long = LongestList(ListA=sort.Keys, ListB=sort_2.Keys, PaddingMode=3)  # -> ListA, ListB
replace = ReplaceMembers(Set=remapedv_3, Find=long.ListA, Replace=long.ListB)
specificsizes = Number(replace)

# ---- group: generatedCircles
list = ValueList({"remapedValues": 0, "roundedValues": 1, "SpecificSizes": 2}, selected="SpecificSizes")
specificsizes_2 = Number(specificsizes)
remapedv_4 = Number(V)
roundedvalues_2 = Number(roundedvalues)
filter = StreamFilter(Gate=list, Stream0=remapedv_4, Stream1=roundedvalues_2, Stream2=specificsizes_2)
radius = Number(filter)
centerpoints_4 = Point(centerpoints)
cir = Circle(Plane=centerpoints_4, Radius=radius)
preview = CustomPreview(Geometry=cir, Shader=ColourSwatch(SwatchColor=RGB(181, 0, 130)))

# ==== cluster OpenRepoInBrowser
open = ClusterInput()
python = GhPythonScript(open=open)
# ---------- python: Python ----------
""" A simple 'open in browser' script """

import webbrowser

url = 'https://github.com/runxel/grasshopper-examples'

if open:
    webbrowser.open(url, new=2)
# ---------- end python ----------
