# Grasshopper definition blur_points.ghx (Grasshopper 1.0.7)

# ---- group: Generate some points in a boundary with varying density
pt = Point([Point(2, 54, 0), Point(-13, 24.06210122, 0), Point(17.38051722, 37, 0), Point(51.99005585, 14, 0), Point(29, -32.07951291, 0)])
# Blur Points
# https://github.com/runxel/grasshopper-examples
srf = Surface(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)
popgeo = PopulateGeometry(Geometry=srf, Count=2000, Seed=1)
cp = ClosestPoint(Point=popgeo, Cloud=pt)  # -> ClosestPoint, CPIndex, Distance
sort = SortList(Keys=cp.Distance, ValuesA=popgeo)  # -> Keys, ValuesA
jitter = Jitter(List=sort.ValuesA, Jitter=Slider(0.318, range=0..1), Seed=2)  # -> Values, Indices
split = SplitList(List=jitter.Values, Index=Slider(1154, range=1..2000))  # -> ListA, ListB

# ----
visit_the_website = Button()
orib = OpenRepoInBrowser(open=visit_the_website)
pt_2 = Point(split.ListA)

# ---- group: Blurring the points
pt_3 = Point(expr("x + {120,0,0}", pt_2))
blur_distance = Slider(14.354, range=0..20)
lng = ListLength(List=pt_3)
random = Random(Range=Domain(0, 6.283185307), Number=lng, Seed=2)
random_2 = Random(Range=blur_distance, Number=lng, Seed=86)
X = UnitX(Factor=random_2)
vrot = Rotate(Vector=X, Axis=Vector(0, 0, 1), Angle=random)
move = Move(Geometry=pt_3, Motion=vrot)  # -> Geometry, Transform

# ==== cluster OpenRepoInBrowser
open = ClusterInput()
python = GhPythonScript(open=open)
# ---------- python: Python ----------
""" A simple 'open in browser' script """

import webbrowser

url = 'https://github.com/runxel/grasshopper-examples'

if open:
    webbrowser.open(url, new=2)
# ---------- end python ----------
