# Grasshopper definition calculate_curvature.ghx (Grasshopper 1.0.7)

# ----
# Calculating the Curvature of a random Point on a Curve
# https://github.com/runxel/grasshopper-examples
curve = Curve(reparameterize(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))
preview = CustomPreview(Geometry=curve, Material=ColourSwatch(SwatchColor=RGB(0, 217, 255)))

# ----
# Point on curve
# (reparameterized)
t = Slider(0.5, range=0..1)

# ---- group: Calculation
# Unitize vector
derivatives = Derivatives(Curve=curve, Parameter=t)  # -> Point, FirstDerivative, SecondDerivative
expression = Expression(d1=derivatives.FirstDerivative, Expression="[d1]")
expression_2 = Expression(d1=derivatives.FirstDerivative, d2=derivatives.SecondDerivative, T=expression, Expression="(d2-(d2 • T) *T)/(d1•d1)")
vector_display = VectorDisplay(Anchor=derivatives.Point, Vector=expression_2)
vlen = VectorLength(Vector=expression_2)
panel = Panel([expression_2, vlen])

# ---- group: via component
curvature = Curvature(Curve=curve, Parameter=t)  # -> Pt, Curv_V, Circ
darc = DeconstructArc(Arc=curvature.Circ)  # -> BasePlane, Radius, Angle
circle = Circle(curvature.Circ)
preview_2 = CustomPreview(Geometry=circle, Material=ColourSwatch(SwatchColor=RGB(72, 207, 133)))
expression_3 = Expression(v=curvature.Curv_V, r=darc.Radius, Expression="[v] * r * 0.7")
vector_display_2 = VectorDisplay(Anchor=derivatives.Point, Vector=expression_3)
vlen_2 = VectorLength(Vector=curvature.Curv_V)
panel_2 = Panel([curvature.Curv_V, vlen_2])

# ----
visit_the_website = Button()
orib = OpenRepoInBrowser(open=visit_the_website)

# ==== cluster OpenRepoInBrowser
open = ClusterInput()
python = GhPythonScript(open=open)
# ---------- python: Python ----------
""" A simple 'open in browser' script """

import webbrowser

url = 'https://github.com/runxel/grasshopper-examples'

if open:
    webbrowser.open(url, new=2)
# ---------- end python ----------
