# Grasshopper definition circle_size_gradient.ghx (Grasshopper 1.0.7)

# Circle Size Gradient
# https://github.com/runxel/grasshopper-examples
number_slider = Slider(45, range=0..360)
xy = XYPlane(Origin=Point(0, 0, 0))
rad = Radians(Degrees=number_slider)
rotate = Rotate(Geometry=xy, Angle=rad, Plane=PlaneXY(0, 0, 0))  # -> Geometry, Transform
size = Slider(16, range=5..100)
visit_the_website = Button()
sqgrid = Square(Plane=rotate.Geometry, Size=1, ExtentX=size, ExtentY=size)  # -> Cells, flatten(Points)
orib = OpenRepoInBrowser(open=visit_the_website)
devec = DeconstructVector(Vector=sqgrid.Points)  # -> XComponent, YComponent, ZComponent
bnd = Bounds(Numbers=devec.YComponent)
dom = ConstructDomain(DomainStart=0.1, DomainEnd=0.5)
remap = RemapNumbers(Value=devec.YComponent, Source=bnd, Target=dom)  # -> Mapped, Clipped
dom_2 = ConstructDomain(DomainStart=Slider(17, range=1..20), DomainEnd=-1)
rectangle = Rectangle(Plane=rotate.Geometry, XSize=dom_2, YSize=dom_2, Radius=0)  # -> Rectangle, Length
cir = Circle(Plane=sqgrid.Points, Radius=remap.Mapped)

# ==== cluster OpenRepoInBrowser
open = ClusterInput()
python = GhPythonScript(open=open)
# ---------- python: Python ----------
""" A simple 'open in browser' script """

import webbrowser

url = 'https://github.com/runxel/grasshopper-examples'

if open:
    webbrowser.open(url, new=2)
# ---------- end python ----------
