# Grasshopper definition crossing_lines_intensity.ghx (Grasshopper 1.0.7)

# Crossing Lines Intensity
# https://github.com/runxel/grasshopper-examples
crv = Curve([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])
mcx = MultipleCurves(Curves=crv)  # -> Points, IndexA, IndexB, ParamA, ParamB
pt = ConstructPoint(XCoordinate=0, YCoordinate=0, ZCoordinate=0)
Z = UnitZ(Factor=1)
line = LineSDL(Start=pt, Direction=Z, Length=Slider(2.3, range=1..20))
visit_the_website = Button()
pframes = PerpFrames(Curve=line, Count=10, Align=True)  # -> Frames, Parameters
orib = OpenRepoInBrowser(open=visit_the_website)
metaball_t = MetaBallT(Points=mcx.Points, Plane=pframes.Frames, Threshold=Slider(0.8137, range=0.01..1))
preview = CustomPreview(Geometry=metaball_t, Shader=ColourSwatch(SwatchColor=RGB(49, 224, 108)))

# ==== cluster OpenRepoInBrowser
open = ClusterInput()
python = GhPythonScript(open=open)
# ---------- python: Python ----------
""" A simple 'open in browser' script """

import webbrowser

url = 'https://github.com/runxel/grasshopper-examples'

if open:
    webbrowser.open(url, new=2)
# ---------- end python ----------
