# Grasshopper definition curvature_zero.ghx (Grasshopper 1.0.7)

# Where's curve curvature zero?
# https://github.com/runxel/grasshopper-examples
crv = Curve(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)
resolution = Panel("1000")
divide = DivideCurve(Curve=crv, Count=resolution, Kinks=False)  # -> Points, Tangents, Parameters
curvature = Curvature(Curve=crv, Parameter=divide.Parameters)  # -> P, K, C
move = Move(Geometry=curvature.P, Motion=expr("25 * x", curvature.K))  # -> Geometry, Transform
nurbs = NurbsCurve(Vertices=move.Geometry, Degree=3, Periodic=False)  # -> Curve, Length, Domain
visit_the_website = Button()

custom_preview = CustomPreview(Geometry=nurbs.Curve, Shader=ColourSwatch(SwatchColor=RGB(0, 255, 238)))

curvature_graph = CurvatureGraph(Curve=crv, Density=10, Scale=105)
ccx = CurveCurve(CurveA=crv, CurveB=nurbs.Curve)  # -> Points, ParamsA, ParamsB
orib = OpenRepoInBrowser(open=visit_the_website)

# ==== cluster OpenRepoInBrowser
open = ClusterInput()
python = GhPythonScript(open=open)
# ---------- python: Python ----------
""" A simple 'open in browser' script """

import webbrowser

url = 'https://github.com/runxel/grasshopper-examples'

if open:
    webbrowser.open(url, new=2)
# ---------- end python ----------
