# Grasshopper definition datatree_list_shifting.ghx (Grasshopper 1.0.7)

# Datatree: Advanced List Shifting
# https://github.com/runxel/grasshopper-examples
number_of_lists = Slider(4, range=0..10)
subtraction = Subtraction(A=number_of_lists, B="1")
seq = Sequence(Count=number_of_lists, CharPool="ABCDEFGHIJKLMNOPQRSTUVWXYZ", Format="{0}")  # -> graft(Sequence)
series = Series(Start="1", Step=1, Count=subtraction)
series_2 = Series(Start=0, Step=1, Count=number_of_lists)
visit_the_website = Button()
int = Integer(series)
int_2 = Integer(series_2)
concat = Concatenate(FragmentA=seq, FragmentB=int)  # -> simplify(Result)
orib = OpenRepoInBrowser(open=visit_the_website)
shift = ShiftList(List=concat, Shift=simplify(graft(int_2)), Wrap=True)  # -> simplify(List)
initial_tree = Panel(concat)
flip = FlipMatrix(Data=shift)
reordered_lists = Panel(flip)

# ==== cluster OpenRepoInBrowser
open = ClusterInput()
python = GhPythonScript(open=open)
# ---------- python: Python ----------
""" A simple 'open in browser' script """

import webbrowser

url = 'https://github.com/runxel/grasshopper-examples'

if open:
    webbrowser.open(url, new=2)
# ---------- end python ----------
