# Grasshopper definition datatree_replace_items_in_path.ghx (Grasshopper 1.0.7)

data = Data(Tree({0}: [0, 1, 2, 3, 4, 5, 6, 7, 8, 9], {1}: [0, 1, 2, 3, 4, 5, 6, 7, 8, 9], {2}: [0, 1, 2, 3, 4, 5, 6, 7, 8, 9], {3}: [0, 1, 2, 3, 4, 5, 6, 7, 8, 9], {4}: [0, 1, 2, 3, 4, 5, 6, 7, 8, 9], {5}: [0, 1, 2, 3, 4, 5, 6, 7, 8, 9], {6}: [0, 1, 2, 3, 4, 5, 6, 7, 8, 9], {7}: [0, 1, 2, 3, 4, 5, 6, 7, 8, 9], {8}: [0, 1, 2, 3, 4, 5, 6, 7, 8, 9], {9}: [0, 1, 2, 3, 4, 5, 6, 7, 8, 9], {10}: [0, 1, 2, 3, 4, 5, 6, 7, 8, 9], {11}: [0, 1, 2, 3, 4, 5, 6, 7, 8, 9]))
# Datatree: Replace Items in Path
# https://github.com/runxel/grasshopper-examples
viewer = ParamViewer(data)
tstat = TreeStatistics(Tree=data)  # -> Paths, Length, Count
panel = Panel(data)
item = ListItem(List=tstat.Paths, Index=Slider(1, range=0..10), Wrap=True)
visit_the_website = Button()
split = SplitTree(Data=data, Masks=flatten(item))  # -> Positive, Negative
path_index_to_replace = Panel(item)
orib = OpenRepoInBrowser(open=visit_the_website)
panel_2 = Panel("""6
7
8
9""")
replace = ReplaceItems(List=split.Positive, Item="NULL", Indices=panel_2, Wrap=False)
pshift = ShiftPaths(Data=replace, Offset=-1)
merge = Merge(Data1=pshift, Data2=split.Negative)
panel_3 = Panel(merge)

# ==== cluster OpenRepoInBrowser
open = ClusterInput()
python = GhPythonScript(open=open)
# ---------- python: Python ----------
""" A simple 'open in browser' script """

import webbrowser

url = 'https://github.com/runxel/grasshopper-examples'

if open:
    webbrowser.open(url, new=2)
# ---------- end python ----------
