# Grasshopper definition datatree_selecting_items.ghx (Grasshopper 1.0.7)

panel = Panel("http://www.grasshopper3d.com/forum/topics/datatree-selection-rules")
# Datatree: Selecting Items
# https://github.com/runxel/grasshopper-examples
square = Square(
    Plane=[PlaneXY(-0.1, -0.1, 0), Plane(origin=(56, 38, 0), x=(0.9411744893, 0.337920968, 0), y=(-0.237006871, 0.6601094394, 0.712799601))],
    Size=4,
    ExtentX=12,
    ExtentY=12)  # -> Cells, simplify(Points)

# ---- group: masks
panel_2 = Panel("{0;0}")
panel_3 = Panel("""{0;0}
{0;2}
{0;4}
{1;0}""")
panel_4 = Panel("""{0,1;0}
{0,1;2}
{0,1;4}
{0,1;6}
{0,1;8}""")
panel_5 = Panel("""{?;0}
{?;2}
{?;4}
{?;6}
{?;8}""")
panel_6 = Panel("{?;(0,2,...)}")
panel_7 = Panel("{?;(2 to 4)}")
panel_8 = Panel("{?;(>2)}")
panel_9 = Panel("{?;(1 to 7) and !5}")
panel_10 = Panel("{?;!(0,3,5,...)}")
panel_11 = Panel("{?;(0,2,...)}[0,2,...]")

# ----
panel_12 = Panel("{?;(0,2,...,10)}")
visit_the_website = Button()
split_tree = SplitTree(Data=square.Points, Masks=flatten(panel_11))  # -> Positive, Negative
point_list = PointList(Points=square.Points, Tags=True, Lines=True, Size=1.5)
orib = OpenRepoInBrowser(open=visit_the_website)
param_viewer = ParamViewer(square.Points)

symsim = SymbolSimple(Style=3, Size=Slider(8, range=0..10), Rotation=0, Colour=RGB(255, 105, 180))
symbol = SymbolDisplay(Location=split_tree.Positive, Display=symsim)

# ==== cluster OpenRepoInBrowser
open = ClusterInput()
python = GhPythonScript(open=open)
# ---------- python: Python ----------
""" A simple 'open in browser' script """

import webbrowser

url = 'https://github.com/runxel/grasshopper-examples'

if open:
    webbrowser.open(url, new=2)
# ---------- end python ----------
