# Grasshopper definition datatree_traversing.ghx (Grasshopper 1.0.7)

# ---- group: offset strings
panel = Panel("{0;0;+1}[0]")
panel_2 = Panel("{0;0;+1}[+1]")
panel_3 = Panel("""{0;0;+1}[+1]
{0;0;+1}[-1]""")
panel_4 = Panel("""{0;0;+1}[ 0]
{0;0;+1}[+1]
{0;0; 0}[+1]
{0;0;+1}[-1]""")

# ----
# Datatree: Traversing with 'Relative Item'
# https://github.com/runxel/grasshopper-examples
square = Square(Plane=PlaneXY(0, 0, 0), Size=5, ExtentX=8, ExtentY=12)  # -> Cells, Points
filter = StreamFilter(Gate=Slider(1, range=0..3), Stream0=panel, Stream1=panel_2, Stream2=panel_3, Stream3=panel_4)
visit_the_website = Button()
boolean_toggle = BooleanToggle(False)
relative_item = RelativeItem(Tree=square.Points, Offset=filter, WrapPaths=boolean_toggle, WrapItems=boolean_toggle)  # -> ItemA, ItemB
point_list = PointList(Points=square.Points, Tags=True, Lines=True, Size=1.4)
orib = OpenRepoInBrowser(open=visit_the_website)
line = Line(StartPoint=relative_item.ItemA, EndPoint=relative_item.ItemB)
item = CherryPicker(line, ListIndex=0, TreePath_path="{0;0;0}")
join_curves = JoinCurves(Curves=line, Preserve=True)
viewer = ParamViewer(line)
preview = CustomPreview(Geometry=join_curves, Material=ColourSwatch(SwatchColor=RGB(255, 0, 212)))
preview_2 = CustomPreview(Geometry=item, Material=ColourSwatch(SwatchColor=RGB(0, 255, 55)))

# ==== cluster OpenRepoInBrowser
open = ClusterInput()
python = GhPythonScript(open=open)
# ---------- python: Python ----------
""" A simple 'open in browser' script """

import webbrowser

url = 'https://github.com/runxel/grasshopper-examples'

if open:
    webbrowser.open(url, new=2)
# ---------- end python ----------
