# Grasshopper definition diagrid_on_surface.ghx (Grasshopper 1.0.7)

# Easy Diagrid on a Surface
# https://github.com/runxel/grasshopper-examples
srf = Surface(reparameterize(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))
divide = DivideDomain²(Domain=srf, UCount=Slider(9, range=0..100), VCount=Slider(9, range=0..100))
subsrf = Isotrim(Surface=srf, Domain=divide)
visit_the_website = Button()
md_slider = MDSlider(SliderMode=0, slider_value=Point(0, 0, 0.5), x_domain=Domain(0, 1), y_domain=Domain(0, 1), z_domain=Domain(0, 1))
md_slider_2 = MDSlider(SliderMode=0, slider_value=Point(1, 0, 0.5), x_domain=Domain(0, 1), y_domain=Domain(0, 1), z_domain=Domain(0, 1))
debrep = DeconstructBrep(Brep=subsrf)  # -> Faces, Edges, Vertices
orib = OpenRepoInBrowser(open=visit_the_website)
md_slider_3 = MDSlider(SliderMode=0, slider_value=Point(1, 1, 0.5), x_domain=Domain(0, 1), y_domain=Domain(0, 1), z_domain=Domain(0, 1))
md_slider_4 = MDSlider(SliderMode=0, slider_value=Point(0, 1, 0.5), x_domain=Domain(0, 1), y_domain=Domain(0, 1), z_domain=Domain(0, 1))
crvsrf = CurveOnSurface(Surface=reparameterize(debrep.Faces), UVCoordinates=[md_slider, md_slider_3], Closed=False)  # -> Curve, Length, Domain
crvsrf_2 = CurveOnSurface(Surface=reparameterize(debrep.Faces), UVCoordinates=[md_slider_4, md_slider_2], Closed=False)  # -> Curve, Length, Domain

# ==== cluster OpenRepoInBrowser
open = ClusterInput()
python = GhPythonScript(open=open)
# ---------- python: Python ----------
""" A simple 'open in browser' script """

import webbrowser

url = 'https://github.com/runxel/grasshopper-examples'

if open:
    webbrowser.open(url, new=2)
# ---------- end python ----------
