# Grasshopper definition douglas-pecker_smoothing.ghx (Grasshopper 1.0.7)

# Douglas-Pecker Algorithm for Smoothing Out Polylines
# https://github.com/runxel/grasshopper-examples
base_curves = Curve([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])
join = JoinCurves(Curves=base_curves, Preserve=False)
cp = ControlPoints(Curve=join)  # -> simplify(Points), Weights, Knots
# Smoothing param
# (higher = more)
knob = ControlKnob(Decimals=3, Limit=True, Maximum=5, Minimum=0, Range=1, Value=2.319)
dam = DataDam(DataA=cp.Points, BufferDelay=10000000, BufferMode=0)
visit_the_website = Button()
# set to "Tree Access"
python = PythonScript(pts=dam, epsilon=knob)  # -> reduced; inputs pts: tree of Point3d
# ---------- python: Python ----------
"""
The Ramer-Douglas-Peucker algorithm roughly ported from the pseudo-code provided
on http://en.wikipedia.org/wiki/Ramer-Douglas-Peucker_algorithm
and https://github.com/sebleier/RDP
"""
# http://developer.rhino3d.com/5/guides/rhinopython/grasshopper-datatrees-and-python/
# http://cu.t-ads.org/tips-datatree-in-python/

import rhinoscriptsyntax as rs
import Grasshopper.Kernel.Data.GH_Path as ghpath
import Grasshopper.DataTree as datatree
import System
from math import sqrt

# FUNCTIONS -----------------------------------------------------------
def distance(a, b):
    return  sqrt((a[0] - b[0]) ** 2 + (a[1] - b[1]) ** 2)

def point_line_distance(point, start, end):
    if (start == end):
        return distance(point, start)
    else:
        n = abs(
            (end[0] - start[0]) * (start[1] - point[1]) - (start[0] - point[0]) * (end[1] - start[1])
        )
        d = sqrt(
            (end[0] - start[0]) ** 2 + (end[1] - start[1]) ** 2
        )
        return n / d

def rdp(points, epsilon):
    """
    Reduces a series of points to a simplified version that loses detail, but
    maintains the general shape of the series.
    """
    dmax = 0.0
    index = 0
    for i in range(1, len(points) - 1):
        d = point_line_distance(points[i], points[0], points[-1])
        if d > dmax:
            index = i
            dmax = d
    if dmax > epsilon:
        results = rdp(points[:index+1], epsilon)[:-1] + rdp(points[index:], epsilon)
    else:
        results = [points[0], points[-1]]
    return results
# ---------------------------------------------------------------------


mytree = datatree[System.Object]() # make a DataTree
a = []

for i in range(pts.BranchCount):
    # get data in <path i> as list
    branchList = pts.Branch(i)

    temp = []
    rslt = []
    ptlist = []

    for j in range(branchList.Count):
        # tuple conversion for the RDP algo
        temp.append((branchList[j].X,branchList[j].Y))

    rslt.append(rdp(temp, epsilon))
    for inlist in rslt:
        for pt in inlist:
            # return points
            ptlist.append(rs.AddPoint(pt[0],pt[1],0))
    path = ghpath(i)
    mytree.AddRange(ptlist, path)

reduced_ = mytree
# ---------- end python ----------

lng = ListLength(NAfter=python)
lng_2 = ListLength(NBefore=dam)
division = Division(A=lng, B=lng_2)  # -> flatten(Result)
ma = MassAddition(Input=division)  # -> Result, PartialResults
list_length = ListLength(List=division)
division_2 = Division(A=ma.Result, B=list_length)  # -> flatten(Result)
fragment = TextFragment(Text=division_2, Start=2, Count=2)
concat = Concatenate(FragmentA=fragment, FragmentB="%")

# ---- group: Reduction by
panel = Panel(concat)

# ----
viewer = ParamViewer(dam)
orib = OpenRepoInBrowser(open=visit_the_website)
viewer_2 = ParamViewer(python)
pt = Point(python)
pline = PolyLine(Vertices=pt, Closed=False)

preview = CustomPreview(Geometry=[pline, pt], Shader=ColourSwatch(SwatchColor=RGB(245, 217, 7)))

# ==== cluster OpenRepoInBrowser
open = ClusterInput()
python = GhPythonScript(open=open)
# ---------- python: Python ----------
""" A simple 'open in browser' script """

import webbrowser

url = 'https://github.com/runxel/grasshopper-examples'

if open:
    webbrowser.open(url, new=2)
# ---------- end python ----------
