# Grasshopper definition escheresque_pattern.ghx (Grasshopper 1.0.7)

# Escheresque Pattern
# https://github.com/runxel/grasshopper-examples
x_grid_elements = Slider(16, range=0..20)
y_grid_elements = Slider(8, range=0..10)
crv = Curve(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)
crv_2 = Curve(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)
crv_3 = Curve(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)
crv_4 = Curve(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)
crv_5 = Curve(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)
filter = StreamFilter(Gate=Slider(0, range=0..4), Stream0=crv, Stream1=crv_2, Stream2=crv_5, Stream3=crv_3, Stream4=crv_4)
hexgrid = Hexagonal(Plane=PlaneXY(0, 0, 0), Size="10", ExtentX=x_grid_elements, ExtentY=y_grid_elements)  # -> Cells, Points

preview = CustomPreview(Geometry=hexgrid.Cells, Material=ColourSwatch(SwatchColor=RGB(178, 209, 191)))

visit_the_website = Button()
explode = BrepComponents(Brep=simplify(hexgrid.Cells))  # -> Faces, Edges, Vertices
orib = OpenRepoInBrowser(open=visit_the_website)
end = EndPoints(Curve=filter)  # -> Start, End
item = ListItem(List=explode.Edges, Index=0, Wrap=True)  # -> Item, Item1, Item2, Item3, Item4, Item5
vec2pt = Vector2Pt(PointA=end.Start, PointB=end.End, Unitize=False)  # -> Vector, Length
end_2 = EndPoints(Curve=[item.Item, item.Item2, item.Item4])  # -> Start, End
end_3 = EndPoints(Curve=[item.Item1, item.Item3, item.Item5])  # -> Start, End
vec2pt_2 = Vector2Pt(PointA=end_2.Start, PointB=end_2.End, Unitize=False)  # -> Vector, Length
vec2pt_3 = Vector2Pt(PointA=end_3.End, PointB=end_3.Start, Unitize=False)  # -> Vector, Length
orient = OrientDirection(Geometry=filter, PointA=end.Start, DirectionA=vec2pt.Vector, PointB=end_2.Start, DirectionB=vec2pt_2.Vector)  # -> Geometry, Transform
orient_2 = OrientDirection(Geometry=filter, PointA=end.Start, DirectionA=vec2pt.Vector, PointB=end_3.End, DirectionB=vec2pt_3.Vector)  # -> Geometry, Transform
merge = Merge(Data1=orient.Geometry, Data2=orient_2.Geometry)
join = JoinCurves(Curves=merge, Preserve=False)
planar = PlanarSrf(Edges=join)

area = Area(Geometry=join)  # -> Area, Centroid
pdecon = Deconstruct(Point=area.Centroid)  # -> XComponent, YComponent, ZComponent
bnd = Bounds(Numbers=flatten(pdecon.YComponent))
dedomain = DeconstructDomain(Domain=bnd)  # -> Start, End
gradient = Gradient(
    LowerLimit=dedomain.Start,
    UpperLimit=dedomain.End,
    Parameter=pdecon.YComponent,
    stops=[0: RGB(107, 24, 24), 0.125: RGB(138, 17, 39), 0.368: RGB(145, 66, 38), 0.705: RGB(130, 158, 44), 1: RGB(108, 232, 30)])

lng = ListLength(List=flatten(planar))
random = Random(Range="0 to 255", Number=lng, Seed=Slider(85, range=0..255), Integers=True)
random_2 = Random(Range="0 to 255", Number=lng, Seed=Slider(0, range=0..255), Integers=True)
random_3 = Random(Range="0 to 255", Number=lng, Seed=Slider(0, range=0..255), Integers=True)
entwine = Entwine(Branch00=random, Branch01=random_2, Branch02=random_3, FlattenInputs=True)
flip = FlipMatrix(Data=entwine)
join_2 = StringJoin(Strings=flip, Join=",")

wheel = ColourWheel(
    lng,
    ColourGrips_Style=40,
    ColourGrips_Grip=[6.215907513, 0.6050336435, 3.545254603, 1.957078253],
    ColourGrips_Lum=[0.3360970749, 0.7541972697],
    ColourGrips_Range=[0.09943457391, 0.2967654109, 0.8210737104, 0.1896412189],
    ColourGrips_Sat=[0.1786710807, 0.595607894])
graft = GraftTree(Tree=wheel, IncludeEmptyLists=True, IncludeNullItems=True)

list = ValueList({"Random": 0, "Color Wheel": 1, "Gradient": 2}, selected="Gradient")
filter_2 = StreamFilter(Gate=list, Stream0=join_2, Stream1=graft, Stream2=gradient)
preview_2 = CustomPreview(Geometry=planar, Shader=filter_2)

# ==== cluster OpenRepoInBrowser
open = ClusterInput()
python = GhPythonScript(open=open)
# ---------- python: Python ----------
""" A simple 'open in browser' script """

import webbrowser

url = 'https://github.com/runxel/grasshopper-examples'

if open:
    webbrowser.open(url, new=2)
# ---------- end python ----------
