# Grasshopper definition geometry_filling_with_gradient.ghx (Grasshopper 1.0.7)

# ----
# Geometry Filling with Gradient
# https://github.com/runxel/grasshopper-examples
colour_swatch = ColourSwatch(SwatchColor=RGB(252, 63, 73))
colour_swatch_2 = ColourSwatch(SwatchColor=RGB(32, 161, 161))
merge = Merge(Data1=colour_swatch, Data2=colour_swatch_2)  # -> graft(Result)

crv = Curve([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])
boundary = BoundarySurfaces(Edges=crv)
group = Group(Objects=boundary)
series = Series(Start=0, Step=Slider(43, range=0..100), Count=4)
Y = UnitY(Factor=expr("-x", series))
move = Move(Geometry=group, Motion=Y)  # -> Geometry, Transform
visit_the_website = Button()
bang = ExplodeTree(Data=simplify(graft(move.Geometry)))  # -> Branch0, Branch1, Branch2, Branch3
orib = OpenRepoInBrowser(open=visit_the_website)
ungroup = Ungroup(Group=bang.Branch0)
ungroup_2 = Ungroup(Group=bang.Branch1)
ungroup_3 = Ungroup(Group=bang.Branch2)
ungroup_4 = Ungroup(Group=bang.Branch3)

# ---- group: Rectangles
bbox = BoundingBox(Content=ungroup_4, Plane=PlaneXY(0, 0, 0), UnionBox=True)  # -> Box, Box_2
rec = Rectangle(bbox.Box)
disc = Discontinuity(Curve=rec, Level=1)  # -> Points, Parameters
item = ListItem(List=disc.Points, Index=0, Wrap=True)
sqgrid = Square(Plane=item, Size=Slider(1.5, range=0..5), ExtentX=Slider(105, range=0..1000), ExtentY=Slider(25, range=0..200))  # -> flatten(Cells), Points
area = Area(Geometry=sqgrid.Cells)  # -> Area, Centroid
srf_cp = SurfaceClosestPoint(Point=area.Centroid, Surface=graft(ungroup_4))  # -> Point, UVPoint, Distance
smaller = SmallerThan(FirstNumber=srf_cp.Distance, SecondNumber="0.01")  # -> SmallerThan, OrEqualTo
cull = CullPattern(List=sqgrid.Cells, CullPattern=smaller.SmallerThan)  # -> flatten(List)
area_2 = Area(Geometry=cull)  # -> Area, Centroid
pdecon = Deconstruct(Point=area_2.Centroid)  # -> XComponent, YComponent, ZComponent
sort = SortList(Keys=pdecon.XComponent, ValuesA=cull)  # -> Keys, ValuesA
boundary_2 = BoundarySurfaces(Edges=sort.ValuesA)
lng = ListLength(List=boundary_2)
jitter = Jitter(List=boundary_2, Jitter=Slider(0.3, range=0..1), Seed=2)  # -> Values, Indices
division = Division(A=lng, B="2")
partition = PartitionList(List=jitter.Values, Size=division)
bang_2 = ExplodeTree(Data=partition)  # -> Branch0, Branch1
preview = CustomPreview(Geometry=bang_2.Branch0, Material=colour_swatch)
preview_2 = CustomPreview(Geometry=bang_2.Branch1, Material=colour_swatch_2)

# ---- group: Circles
popgeo = PopulateGeometry(Geometry=ungroup, Count=Slider(300, range=0..500), Seed=Slider(0, range=0..10))  # -> flatten(Population)
pdecon_2 = Deconstruct(Point=popgeo)  # -> XComponent, YComponent, ZComponent
sort_2 = SortList(Keys=pdecon_2.XComponent, ValuesA=popgeo)  # -> Keys, ValuesA
cir = Circle(Plane=sort_2.ValuesA, Radius=Slider(0.5, range=0..1))  # -> flatten(Circle)
boundary_3 = BoundarySurfaces(Edges=cir)
lng_2 = ListLength(List=boundary_3)
jitter_2 = Jitter(List=boundary_3, Jitter=Slider(0.3, range=0..1), Seed=2)  # -> Values, Indices
division_2 = Division(A=lng_2, B="2")
partition_2 = PartitionList(List=jitter_2.Values, Size=division_2)
preview_3 = CustomPreview(Geometry=partition_2, Material=merge)

# ---- group: using Rhino 6 GH1 symbs
popgeo_2 = PopulateGeometry(Geometry=ungroup_2, Count=Slider(175, range=0..500), Seed=Slider(0, range=0..10))  # -> flatten(Population)
pdecon_3 = Deconstruct(Point=popgeo_2)  # -> XComponent, YComponent, ZComponent
sort_3 = SortList(Keys=pdecon_3.XComponent, ValuesA=popgeo_2)  # -> Keys, ValuesA
jitter_3 = Jitter(List=sort_3.ValuesA, Jitter=Slider(0.3, range=0..1), Seed=2)  # -> Values, Indices
lng_3 = ListLength(List=jitter_3.Values)
division_3 = Division(A=lng_3, B="2")
symsim = SymbolSimple(Style=7, Size=Slider(12, range=0..20), Rotation=0, Colour=flatten(merge))
partition_3 = PartitionList(List=jitter_3.Values, Size=division_3)
symbol = SymbolDisplay(Location=partition_3, Display=graft(symsim))

# ---- group: Quads boundaries
bbox_2 = BoundingBox(Content=ungroup_3, Plane=PlaneXY(0, 0, 0), UnionBox=True)  # -> Box, Box_2
rec_2 = Rectangle(bbox_2.Box)
disc_2 = Discontinuity(Curve=rec_2, Level=1)  # -> Points, Parameters
item_2 = ListItem(List=disc_2.Points, Index=0, Wrap=True)
sqgrid_2 = Square(Plane=item_2, Size=Slider(1.5, range=0..5), ExtentX=Slider(105, range=0..1000), ExtentY=Slider(25, range=0..200))  # -> flatten(Cells), Points
pcen = PolygonCenter(Polyline=sqgrid_2.Cells)  # -> CenterV, CenterE, CenterA
srf_cp_2 = SurfaceClosestPoint(Point=pcen.CenterV, Surface=graft(ungroup_3))  # -> Point, UVPoint, Distance
smaller_2 = SmallerThan(FirstNumber=srf_cp_2.Distance, SecondNumber="0.01")  # -> SmallerThan, OrEqualTo
cull_2 = CullPattern(List=sqgrid_2.Cells, CullPattern=smaller_2.SmallerThan)  # -> flatten(List)
pcen_2 = PolygonCenter(Polyline=cull_2)  # -> CenterV, CenterE, CenterA
pdecon_4 = Deconstruct(Point=pcen_2.CenterV)  # -> XComponent, YComponent, ZComponent
sort_4 = SortList(Keys=pdecon_4.XComponent, ValuesA=cull_2)  # -> Keys, ValuesA
lng_4 = ListLength(List=sort_4.ValuesA)
jitter_4 = Jitter(List=sort_4.ValuesA, Jitter=Slider(0.3, range=0..1), Seed=2)  # -> Values, Indices
division_4 = Division(A=lng_4, B="2")
partition_4 = PartitionList(List=jitter_4.Values, Size=division_4)
bang_3 = ExplodeTree(Data=partition_4)  # -> Branch0, Branch1

# ----
crv_2 = Curve(bang_3.Branch1)
crv_3 = Curve(bang_3.Branch0)

# ---- group: Quads boundaries (continued)
preview_4 = CustomPreview(Geometry=crv_3, Material=colour_swatch)
preview_5 = CustomPreview(Geometry=crv_2, Material=colour_swatch_2)

# ==== cluster OpenRepoInBrowser
open = ClusterInput()
python = GhPythonScript(open=open)
# ---------- python: Python ----------
""" A simple 'open in browser' script """

import webbrowser

url = 'https://github.com/runxel/grasshopper-examples'

if open:
    webbrowser.open(url, new=2)
# ---------- end python ----------
