# Grasshopper definition helix_along_curve.ghx (Grasshopper 1.0.7)

# ----
# Helix along a Curve
# https://github.com/runxel/grasshopper-examples
input_curve = Curve(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)
segments = Slider(100, range=3..125)
radius = Slider(1.795, range=0..2)
turns = Slider(8.4808, range=0..10)
direction = ValueList({"Top": 0, "Down": 1}, selected="Down")

visit_the_website = Button()
frames = PerpFrames(Curve=input_curve, Count=segments, Align=True)  # -> Frames, Parameters
addition = Addition(A=segments, B=1)
expression = Expression(x=radius, Expression="2*π*x")
division = Division(A=turns, B=addition)
orib = OpenRepoInBrowser(open=visit_the_website)
multiplication = Multiplication(A=division, _1=-1)
stream_filter = StreamFilter(Gate=direction, Stream0=multiplication, Stream1=division)
cir = Circle(Plane=frames.Frames, Radius=radius)
series = Series(Start=0, Step=stream_filter, Count=expr("x+1", addition))
multiplication_2 = Multiplication(A=series, B=expression)
# It's okay for this component to be orange.
evaluate_curve = EvaluateCurve(Curve=cir, Parameter=multiplication_2)  # -> Point, Tangent, Angle
interpolate = Interpolate(Vertices=evaluate_curve.Point, Degree=3, Periodic=False, KnotStyle=0)  # -> Curve, Length, Domain

custom_preview = CustomPreview(Geometry=interpolate.Curve, Shader=ColourSwatch(SwatchColor=RGB(132, 255, 0)))

# ==== cluster OpenRepoInBrowser
open = ClusterInput()
python = GhPythonScript(open=open)
# ---------- python: Python ----------
""" A simple 'open in browser' script """

import webbrowser

url = 'https://github.com/runxel/grasshopper-examples'

if open:
    webbrowser.open(url, new=2)
# ---------- end python ----------
