# Grasshopper definition image_based_surface_displacement.ghx (Grasshopper 1.0.7)

# ----
# Displacement of a Surface Based on an Image
# https://github.com/runxel/grasshopper-examples
srf = Surface(reparameterize(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))
resolution_u = Slider(20, range=0..20)
resolution_v = Slider(20, range=0..20)
height_multi = Slider(6.12, range=0..100)

sdivide = DivideSurface(Surface=srf, UCount=resolution_u, VCount=resolution_v)  # -> Points, Normals, Parameters
image = ImageSampler(sdivide.Parameters, Filter="Value", Interpolate=False, Umax=1, Umin=0, Vmax=1, Vmin=0, Wrap=1)
visit_the_website = Button()
multiplication = Multiplication(A=image, B=height_multi)
orib = OpenRepoInBrowser(open=visit_the_website)
multiplication_2 = Multiplication(A=sdivide.Normals, B=multiplication)
move = Move(Geometry=sdivide.Points, Translation=multiplication_2)  # -> Geometry, Transform
srfgrid = SurfaceFromPoints(Points=flatten(move.Geometry), UCount=expr("x+1", resolution_u), Interpolate=False)

# ==== cluster OpenRepoInBrowser
open = ClusterInput()
python = GhPythonScript(open=open)
# ---------- python: Python ----------
""" A simple 'open in browser' script """

import webbrowser

url = 'https://github.com/runxel/grasshopper-examples'

if open:
    webbrowser.open(url, new=2)
# ---------- end python ----------
