# Grasshopper definition make_polyline_segments_even_integers.ghx (Grasshopper 1.0.7)

# Make Polyline Segments Even Integers Long
# https://github.com/runxel/grasshopper-examples
# https://discourse.mcneel.com/t/make-polyline-segments-even-integers/88256/4
geo = Geometry(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)

# ---- group: Curve start point
end = EndPoints(Curve=geo)  # -> Start, End

# ---- group: Round all segment vectors to the nearest multiple of some length
explode = Explode(Curve=geo, Recursive=True)  # -> Segments, Vertices
step_size = Slider(1, range=0.1..4)
end_2 = EndPoints(Curve=explode.Segments)  # -> Start, End
vec2pt = Vector2Pt(PointA=end_2.Start, PointB=end_2.End, Unitize=False)  # -> Vector, Length
expression = Expression(L=vec2pt.Length, S=step_size, Expression="S * CInt(L / S)")
amp = Amplitude(Vector=vec2pt.Vector, Amplitude=expression)

# ---- group: if a segment happens to be shorter than half your unit length, it doesn’t disappear entirely
expression_2 = Expression(L=vec2pt.Length, S=step_size, Expression="Max(S, S*CInt(L/S))")

# ----
visit_the_website = Button()
orib = OpenRepoInBrowser(open=visit_the_website)

# ---- group: Add all scaled vectors together again
ma = MassAddition(Input=amp)  # -> Result, PartialResults
vec = Vector(Vector(0, 0, 0))
ins = InsertItems(List=ma.PartialResults, Item=vec, Indices=0, Wrap=True)
addition = Addition(A=end.Start, B=ins)

# ---- group: Recreate polyline
pline = PolyLine(Vertices=addition, Closed=False)

# ---- group: Validate final segment lengths
explode_2 = Explode(Curve=pline, Recursive=True)  # -> Segments, Vertices
end_3 = EndPoints(Curve=explode_2.Segments)  # -> Start, End
aligndim = AlignedDimension(Plane=PlaneXY(0, 0, 0), PointA=end_3.Start, PointB=end_3.End, Offset=1, Text="{0:0.00}", Size=0.5)

# ----
preview = CustomPreview(Geometry=pline, Material=ColourSwatch(SwatchColor=RGB(34, 255, 0)))

# ==== cluster OpenRepoInBrowser
open = ClusterInput()
python = GhPythonScript(open=open)
# ---------- python: Python ----------
""" A simple 'open in browser' script """

import webbrowser

url = 'https://github.com/runxel/grasshopper-examples'

if open:
    webbrowser.open(url, new=2)
# ---------- end python ----------
