# Grasshopper definition mesh_shadow.ghx (Grasshopper 1.0.7)

# Mesh Shadow and it's Size
# https://github.com/runxel/grasshopper-examples
brep = Brep([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])
vec = Vector(Vector(5, 5, -10))
mshadow = MeshShadow(Mesh=brep, Light=vec, Plane=PlaneXY(0, 0, 0))
mshadow_2 = MeshShadow(Mesh=brep, Light=Vector(0, 0, -1), Plane=PlaneXY(0, 0, 0))
preview = CustomPreview(Geometry=brep, Material=ColourSwatch(SwatchColor=RGB(212, 204, 97)))
rdiff = RegionDifference(CurvesA=mshadow, CurvesB=flatten(mshadow_2))
visit_the_website = Button()
area = Area(Geometry=rdiff)  # -> Area, Centroid
boundary = BoundarySurfaces(Edges=rdiff)
expression = Expression(x=area.Area, Expression="Format(\"{0:0.0}m²\",x)")
orib = OpenRepoInBrowser(open=visit_the_website)
panel = Panel(expression)
tag = TextTag3D(
    Location=area.Centroid,
    Text=expression,
    Size=Slider(11, range=0..100),
    Colour=ColourSwatch(SwatchColor=RGB(255, 255, 255)),
    Justification=5)

# ==== cluster OpenRepoInBrowser
open = ClusterInput()
python = GhPythonScript(open=open)
# ---------- python: Python ----------
""" A simple 'open in browser' script """

import webbrowser

url = 'https://github.com/runxel/grasshopper-examples'

if open:
    webbrowser.open(url, new=2)
# ---------- end python ----------
