# Grasshopper definition objects_along_curve.ghx (Grasshopper 1.0.7)

# ----
# Distribute Objects Along a Curve
# https://github.com/runxel/grasshopper-examples
size = Slider(0.9, range=0..3)
teilung = Slider(20, range=0..20)
height = Slider(8.3, range=0..10)

dom = ConstructDomain(DomainStart=expr("-x/2", size), DomainEnd=expr("x/2", size))
curve = Curve(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)
rectangle = Rectangle(Plane=PlaneXY(0, 0, 0), XSize=dom, YSize=dom, Radius=0)  # -> Rectangle, Length
visit_the_website = Button()
boxrec = BoxRectangle(Rectangle=rectangle.Rectangle, Height=height)
divide = DivideCurve(Curve=curve, Count=teilung, Kinks=False)  # -> Points, Tangents, Parameters
orib = OpenRepoInBrowser(open=visit_the_website)
cdiv = Derivatives(Curve=curve, Parameter=divide.Parameters)  # -> Point, FirstDerivative
X = UnitX(Factor=1)
move = Move(Geometry=boxrec, Motion=divide.Points)  # -> Geometry, Transform
angle = Angle(VectorA=X, VectorB=cdiv.FirstDerivative, Plane=cdiv.Point)  # -> Angle, Reflex
rotate = Rotate(Geometry=move.Geometry, Angle=angle.Angle, Plane=divide.Points)  # -> Geometry, Transform

# ==== cluster OpenRepoInBrowser
open = ClusterInput()
python = GhPythonScript(open=open)
# ---------- python: Python ----------
""" A simple 'open in browser' script """

import webbrowser

url = 'https://github.com/runxel/grasshopper-examples'

if open:
    webbrowser.open(url, new=2)
# ---------- end python ----------
