# Grasshopper definition ovals.ghx (Grasshopper 1.0.7)

# ----
# Ovals
# https://github.com/runxel/grasshopper-examples
# Oval from Arcs (C1)
point = Point(Point(0, 0, 0))
spacing_horizontal = Slider(8, range=2..20)
radius_small = Slider(9, range=1..20)
height = Slider(71, range=5..89)
python_script = PythonScript(spaceH=spacing_horizontal, radiusSmall=radius_small, height=height)  # -> spaceV, radiusBig
# ---------- python_script: Python ----------
# THIS is just for being more concise.
# You don't need Python!

import math
# Standard-Winkel ist 60° (dann funktioniert auch die "Kreismethode"
# der Gegenkathetenwinkel im Dreieck wird berechnet
# um dann die Hypotenuse zu berechnen
degHeight = 90.0 - height
hypotenuse = (spaceH / math.sin( math.radians(degHeight) ) )

# Gegenkathete berechnen (unsere Höhe)
spaceV = math.sqrt( hypotenuse**2 - spaceH**2 )

radiusBig = hypotenuse + radiusSmall
# die längere Kathete
# ---------- end python_script ----------
unit_x = UnitX(Factor=expr("-x", spacing_horizontal))
unit_y = UnitY(Factor=expr("-x", python_script.spaceV))
unit_x_2 = UnitX(Factor=spacing_horizontal)
unit_y_2 = UnitY(Factor=python_script.spaceV)
move = Move(Geometry=point, Motion=unit_x)  # -> Geometry, Transform
move_2 = Move(Geometry=point, Motion=unit_x_2)  # -> Geometry, Transform
move_3 = Move(Geometry=point, Motion=unit_y_2)  # -> Geometry, Transform
move_4 = Move(Geometry=point, Motion=unit_y)  # -> Geometry, Transform
circle = Circle(Plane=move.Geometry, Radius=radius_small)
circle_2 = Circle(Plane=move_2.Geometry, Radius=radius_small)
circle_3 = Circle(Plane=move_3.Geometry, Radius=python_script.radiusBig)
circle_4 = Circle(Plane=move_4.Geometry, Radius=python_script.radiusBig)
curve_curve = CurveCurve(CurveA=circle, CurveB=circle_4)  # -> Points, ParamsA, ParamsB
curve_curve_2 = CurveCurve(CurveA=circle, CurveB=circle_3)  # -> Points, ParamsA, ParamsB
curve_curve_3 = CurveCurve(CurveA=circle_2, CurveB=circle_3)  # -> Points, ParamsA, ParamsB
curve_curve_4 = CurveCurve(CurveA=circle_2, CurveB=circle_4)  # -> Points, ParamsA, ParamsB
shatter = Shatter(Curve=circle, Parameters=[curve_curve.ParamsA, curve_curve_2.ParamsA])
shatter_2 = Shatter(Curve=circle_3, Parameters=[curve_curve_2.ParamsB, curve_curve_3.ParamsB])
shatter_3 = Shatter(Curve=circle_4, Parameters=[curve_curve_4.ParamsB, curve_curve.ParamsB])
shatter_4 = Shatter(Curve=circle_2, Parameters=[curve_curve_4.ParamsA, curve_curve_3.ParamsA])
list_item = ListItem(List=shatter, Index=0, Wrap=True)
list_item_2 = ListItem(List=shatter_2, Index=0, Wrap=True)
list_item_3 = ListItem(List=shatter_3, Index=0, Wrap=True)
list_item_4 = ListItem(List=shatter_4, Index=1, Wrap=True)
join_curves = JoinCurves(Curves=[list_item, list_item_4, list_item_2, list_item_3], Preserve=False)

# ----
# Python only
basept = Point(Point(0, 0, 0))
radius_of_small_circles = Slider(7, range=1..10)
horizontal_spacing = Slider(8, range=1..10)
height_2 = Slider(70, range=10..89)
python = GhPythonScript(BasePt=basept, radiusSmall=radius_of_small_circles, hSpace=horizontal_spacing, height=height_2)  # -> debug, oval, verbose; inputs BasePt: Point3d
# ---------- python: Python ----------
"""
Creating an oval from 4 circles with Python.
"""

######### libs ##########
import Rhino.Geometry as rg
import ghpythonlib.components as gc
import math
from scriptcontext import doc


# CIRCLES #
baseCircleLeft = rg.Circle(rg.Point3d(BasePt.X -hSpace, BasePt.Y, BasePt.Z), radiusSmall)
baseCircleLeft = baseCircleLeft.ToNurbsCurve()
baseCircleLeft.Domain = rg.Interval(0,1)    # reparam crv
baseCircleRight = rg.Circle(rg.Point3d(BasePt.X +hSpace, BasePt.Y, BasePt.Z), radiusSmall)
baseCircleRight = baseCircleRight.ToNurbsCurve()
baseCircleRight.Domain = rg.Interval(0,1)   # reparam crv

# opposite angle + hypotenuse
degHeight = 90.0 - height
hypotenuse = (hSpace / math.sin(math.radians(degHeight)))

# opposite angle
vSpace = math.sqrt( hypotenuse**2 - hSpace**2 )
# radius of bigger circles
radiusBig = hypotenuse + radiusSmall

baseCircleTop = rg.Circle(rg.Point3d(BasePt.X, BasePt.Y +vSpace, BasePt.Z), radiusBig)
baseCircleTop = baseCircleTop.ToNurbsCurve()
baseCircleTop.Domain = rg.Interval(0,1)     # reparam crv
baseCircleBottom = rg.Circle(rg.Point3d(BasePt.X, BasePt.Y -vSpace, BasePt.Z), radiusBig)
baseCircleBottom = baseCircleBottom.ToNurbsCurve()
baseCircleBottom.Domain = rg.Interval(0,1)  # reparam crv


# INTERSECTION #
# intersection params t
cxct1 = [] # will be left
cxct2 = [] # will be right

# get the params
for crc in [baseCircleTop, baseCircleBottom]:
    cxct1.append(gc.CurveXCurve(crc, baseCircleLeft)[2])
    cxct2.append(gc.CurveXCurve(crc, baseCircleRight)[2])

# use the params
splitLeftRight = []
splitLeftRight.extend(baseCircleLeft.Split(cxct1))
splitLeftRight.extend(baseCircleRight.Split(cxct2))
splitTopBottom = []
splitTopBottom.extend(baseCircleTop.Split([cxct1[0], cxct2[0]])) # first t is the bottom param
splitTopBottom.extend(baseCircleBottom.Split([cxct1[1], cxct2[1]]))

# get the inside curves
# by calc'ing shortest pts on crv to BasePt we can deselect unwanted crv
ptclose = []
for _, cpt in enumerate([baseCircleLeft, baseCircleRight, baseCircleTop, baseCircleBottom]):
    ptclose.append(gc.CurveClosestPoint(BasePt, cpt)[0])

lnLR = rg.Line(ptclose[0], ptclose[1]) # left to right
lnTB = rg.Line(ptclose[2], ptclose[3]) # top to bottom

allcrv = []
for crv in splitLeftRight:
    if (gc.CurveXCurve(crv, lnLR)[0] is None):
        allcrv.append(crv)
for crv in splitTopBottom:
    if (gc.CurveXCurve(crv, lnTB)[0]):
        allcrv.append(crv)

# finally the oval
oval = rg.Curve.JoinCurves(allcrv, doc.ModelAbsoluteTolerance)
_verbose = baseCircleLeft, baseCircleRight, baseCircleTop, baseCircleBottom, lnLR, lnTB
# ---------- end python ----------
geo = Geometry(python.oval)

# ----
# Superellipse
panel = Panel("pi/2")
resolution = Slider(100, range=4..100)
width = Slider(6.533, range=1..10)
height_3 = Slider(3.659, range=1..10)
roundness = Slider(3.243, range=1..10)
range = Range(Domain=panel, Steps=resolution)
t = Number(range)
evaluate = Evaluate(fx="a * (cos(t)^(2/n))", t=t, a=width, n=roundness)
evaluate_2 = Evaluate(fx="b * (sin(t)^(2/n))", t=t, b=height_3, n=roundness)
construct_point = ConstructPoint(XCoordinate=evaluate, YCoordinate=evaluate_2, ZCoordinate=0)
interpolate = Interpolate(Vertices=construct_point, Degree=3, Periodic=False, KnotStyle=1)  # -> Curve, Length, Domain
yz_plane = YZPlane(Origin=Point(0, 0, 0))
mirror = Mirror(Geometry=interpolate.Curve, Plane=PlaneYZ(0, 0, 0))  # -> Geometry, Transform
rotate = Rotate(Geometry=yz_plane, Angle=1.570796327, Plane=PlaneXY(0, 0, 0))  # -> Geometry, Transform
mirror_2 = Mirror(Geometry=[interpolate.Curve, mirror.Geometry], Plane=rotate.Geometry)  # -> Geometry, Transform
join_curves_2 = JoinCurves(Curves=[mirror.Geometry, mirror_2.Geometry, interpolate.Curve], Preserve=False)

visit_the_website = Button()
orib = OpenRepoInBrowser(open=visit_the_website)
preview = CustomPreview(Geometry=geo, Shader=ColourSwatch(SwatchColor=RGB(64, 237, 203)))
preview_2 = CustomPreview(Geometry=join_curves, Shader=ColourSwatch(SwatchColor=RGB(174, 12, 207)))
preview_3 = CustomPreview(Geometry=join_curves_2, Shader=ColourSwatch(SwatchColor=RGB(255, 202, 79)))

# ==== cluster OpenRepoInBrowser
open = ClusterInput()
python = GhPythonScript(open=open)
# ---------- python: Python ----------
""" A simple 'open in browser' script """

import webbrowser

url = 'https://github.com/runxel/grasshopper-examples'

if open:
    webbrowser.open(url, new=2)
# ---------- end python ----------
