# Grasshopper definition paraboloids.ghx (Grasshopper 1.0.7)

# Paraboloid
# https://github.com/runxel/grasshopper-examples
number_slider = Slider(-2, range=-10..10)
number_slider_2 = Slider(15, range=3..30)
dom = ConstructDomain(DomainStart=number_slider, DomainEnd=Slider(2, range=-10..10))
dom_2 = ConstructDomain(DomainStart=Slider(-2, range=-10..10), DomainEnd=Slider(2, range=-10..10))
range = Range(Domain=dom, Steps=number_slider_2)
range_2 = Range(Domain=dom_2, Steps=number_slider_2)
visit_the_website = Button()
crossref = CrossReference(ListA=range, ListB=range_2, CrossMode=1)  # -> ListA, ListB
paraboloid = Panel("-((x²+y²)/4)+4")
panel = Panel("((x^3+y^3)/8)")
panel_2 = Panel("(x²-y²)/2")
orib = OpenRepoInBrowser(open=visit_the_website)
eval = Evaluate(F=paraboloid, x=crossref.ListA, y=crossref.ListB)
lng = ListLength(List=range_2)
pt = ConstructPoint(XCoordinate=crossref.ListA, YCoordinate=crossref.ListB, ZCoordinate=eval)
srfgrid = SurfaceFromPoints(Points=pt, UCount=lng, Interpolate=False)

# ==== cluster OpenRepoInBrowser
open = ClusterInput()
python = GhPythonScript(open=open)
# ---------- python: Python ----------
""" A simple 'open in browser' script """

import webbrowser

url = 'https://github.com/runxel/grasshopper-examples'

if open:
    webbrowser.open(url, new=2)
# ---------- end python ----------
