# Grasshopper definition add_menu_items.ghx (Grasshopper 1.0.7)

# Append additional menu items
# https://github.com/runxel/grasshopper-examples
# Rightclick me!
booleancontext = GhPythonScript()  # -> a
# ---------- booleancontext: Python ----------
"""
Context Menu Options in GHPython (RH6 only)
https://discourse.mcneel.com/t/button-and-context-menu-options-on-component-through-ghpython/54638/3
"""

from ghpythonlib.componentbase import executingcomponent as component
import Grasshopper, GhPython
import System
import Rhino
import rhinoscriptsyntax as rs

class Cntxt(component):
    def __init__(self):
        super(Cntxt,self).__init__()
        self.enabled = False
    
    def RunScript(self):
        
        a = self.enabled
        
        return a
    
    def OnTextMenuClick(self, sender, args):
        try: # always everything inside try
            
            self.enabled = not self.enabled
            System.Windows.Forms.MessageBox.Show("I am now {}...".format(self.enabled))
            
            self.ExpireSolution(True)
            
        except Exception, ex:
            System.Windows.Forms.MessageBox.Show(str(ex))
    
    def AppendAdditionalMenuItems(self, items):
        # items is System.Windows.Forms.ContextMenuStrip, a class derived from ToolStripDropDown
        component.AppendAdditionalMenuItems(self, items)
        
        try: # always everything inside try
            image = None
            
            item = items.Items.Add("Additional state to: {}".format(not self.enabled), image, self.OnTextMenuClick)
            
            item.Checked = self.enabled
            
        except Exception, ex:
            System.Windows.Forms.MessageBox.Show(str(ex))
# ---------- end booleancontext ----------
panel = Panel(booleancontext)
visit_the_website = Button()
orib = OpenRepoInBrowser(open=visit_the_website)

# ==== cluster OpenRepoInBrowser
open = ClusterInput()
python = GhPythonScript(open=open)
# ---------- python: Python ----------
""" A simple 'open in browser' script """

import webbrowser

url = 'https://github.com/runxel/grasshopper-examples'

if open:
    webbrowser.open(url, new=2)
# ---------- end python ----------
