# Grasshopper definition code_script_in_editor_of_choice.ghx (Grasshopper 1.0.7)

# Code in your editor of choice
# https://github.com/runxel/grasshopper-examples
# Select a file from anywhere
path = FilePath()
coor = Slider(1.3, range=-5..5)
python = GhPythonScript(fp_in=path)  # -> fp_read
# ---------- python: Python ----------
import os.path

if not fp_in:
    # Get the full path to the current GH doc and strip the name
    # equivalent to ghenv.Component.OnPingDocument().FilePath
    path_dir = os.path.dirname(ghdoc.Path)
    
    # Get the pure name of the current GH doc (has no extension)
    file_name = ghdoc.Name
    # Test if the view is dirty
    if file_name.endswith("*"):
        # View is in fact dirty, so we need to delete the last char (the star)
        file_name = file_name[:-1]
    
    # Join name with the correct extension for the accompanying script
    file_name_ext = file_name + ".py"
    
    # Make the final path to read
    fp_read = os.path.join(path_dir, file_name_ext)

else:
    # Otherwise just pipe through
    fp_read = fp_in
# ---------- end python ----------
file = ReadFile(File=python, PerLineParse=False)
visit_the_website = Button()
python_2 = GhPythonScript(Code=file, X=coor, Y=coor, Z=coor)
orib = OpenRepoInBrowser(open=visit_the_website)

# ==== cluster OpenRepoInBrowser
open = ClusterInput()
python = GhPythonScript(open=open)
# ---------- python: Python ----------
""" A simple 'open in browser' script """

import webbrowser

url = 'https://github.com/runxel/grasshopper-examples'

if open:
    webbrowser.open(url, new=2)
# ---------- end python ----------
