# Grasshopper definition converge_points.ghx (Grasshopper 1.0.7)

# Converge (simplify) Points
# https://github.com/runxel/grasshopper-examples
random = Random(Range=Domain(0, 10), Number=100, Seed=2)
jitter = Jitter(List=random, Jitter=1, Seed=1)  # -> Range, Indices
slider = Slider(1.2901, range=0..10)
pt = PointXYZ(XComponent=random, YComponent=jitter.Range, ZComponent=0)
converge_points = GhPythonScript(pts=pt, tol=slider)  # -> out, conv_pts; inputs pts: list of Point3d
# ---------- converge_points: Python ----------
"""
Converge ("simplify") points.

    Args:
        pts: The points to simplify. Set to LIST ACCESS.
        tol: The tolerance to which the points should be converged.
    Returns:
        conv_pts: The converged/simplified points.
"""

import Rhino.Geometry as rg
from scriptcontext import doc


def Converge(pts, tol):
    delta_pos = []
    check = False
    tol = tol ** 2
    
    for i in range(len(pts)):
        delta_pos.append(LocalCentroid(pts[i], pts, tol) - pts[i])
        if delta_pos[i].X + delta_pos[i].Y + delta_pos[i].Z > doc.ModelAbsoluteTolerance:
            check = True
    
    for i in range(len(pts)):
        pts[i] += delta_pos[i]
    
    return check


def LocalCentroid(pt, pts, tol_sqr):
    center = rg.Point3d(0, 0, 0)
    count = 0
    
    for i in range(len(pts)):
        test_vec = pts[i] - pt
        len_sqr = test_vec.SquareLength
        
        if len_sqr < tol_sqr:
            center += pts[i]
            count += 1
            
    return center / count


### main ###
go = True
n = 0

if tol > 0:
    while go:
        go = Converge(pts, tol)
        n += 1

print "{} iterations".format(n)
conv_pts = pts
# ---------- end converge_points ----------
visit_the_website = Button()
panel = Panel(converge_points.out)
pt_2 = Point(converge_points.conv_pts)
cir = Circle(Plane=pt_2, Radius=slider)

preview = CustomPreview(Geometry=pt, Material=ColourSwatch(SwatchColor=RGB(255, 82, 82)))
preview_2 = CustomPreview(Geometry=pt_2, Material=ColourSwatch(SwatchColor=RGB(152, 235, 222)))
preview_3 = CustomPreview(Geometry=cir, Material=ColourSwatch(SwatchColor=RGB(0, 122, 104)))
