# Grasshopper definition copy_and_translate.ghx (Grasshopper 1.0.7)

# Copy and Translate an Object
# https://github.com/runxel/grasshopper-examples
number_slider = Slider(15, range=0..50)
circle = CircleCNR(Center=Point(0, 0, 0), Normal=Vector(0, 0, 1), Radius=0.5)
python = PythonScript(Crv=circle, N=number_slider)  # -> CrvCopies; inputs Crv: Curve, N: Int32
# ---------- python: Python ----------
import Rhino
import copy

# Make an empty list to add copies to
CrvCopies = []

# Loop N times
for i in range(N):
    
    # Copy the curve
    cc = copy.copy(Crv)
    
    # Move the copy
    tr = Rhino.Geometry.Transform.Translation(Rhino.Geometry.Vector3d(i,0.0,0.0))
    cc.Transform(tr)
    
    # Add to output list
    CrvCopies.append(cc)
# ---------- end python ----------
visit_the_website = Button()
orib = OpenRepoInBrowser(open=visit_the_website)

# ==== cluster OpenRepoInBrowser
open = ClusterInput()
python = GhPythonScript(open=open)
# ---------- python: Python ----------
""" A simple 'open in browser' script """

import webbrowser

url = 'https://github.com/runxel/grasshopper-examples'

if open:
    webbrowser.open(url, new=2)
# ---------- end python ----------
