# Grasshopper definition copy_objects.ghx (Grasshopper 1.0.7)

# Copy an Object
# https://github.com/runxel/grasshopper-examples
# Assignment statements in Python do not copy objects, they create bindings between a target and an object. For collections that are mutable or contain mutable items, a copy is sometimes needed so one can change one copy without changing the other.
circle = Circle({Plane=Plane(origin=(-13.19243343, 5.130300507, 0), x=(0.8035571933, 0.5952275506, 0), y=(-0.5952275506, 0.8035571933, 0)), Radius=8.696843372})
line = Line(Line((8.678704858, -7.5523714, 0), (0.9138036904, 18.71887755, 0)))
python = PythonScript(x=circle, y=line)  # -> a, b; inputs y: Line
# ---------- python: Python ----------
"""
Sometimes you need to copy objects.
See https://docs.python.org/2.7/library/copy.html
"""

import copy

# Check type
print type(x)
print type(y)

# Copy x and y (or use copy.deepcopy())
new_c = copy.copy(x)
new_l = copy.copy(y)

# Check IDs to confirm, we made indeed a deep copy
a = "ID of object x: {} || ID of new object (copied): {}".format(id(x), id(new_c))
b = "ID of object y: {} || ID of new object (copied): {}".format( id(y),id(new_l))
# ---------- end python ----------
# Shallow copies of dictionaries can be made using dict.copy(), and of lists by assigning a slice of the entire list, for example, copied_list = original_list[:]
visit_the_website = Button()
panel = Panel(python.a)
panel_2 = Panel(python.b)
orib = OpenRepoInBrowser(open=visit_the_website)

# ==== cluster OpenRepoInBrowser
open = ClusterInput()
python = GhPythonScript(open=open)
# ---------- python: Python ----------
""" A simple 'open in browser' script """

import webbrowser

url = 'https://github.com/runxel/grasshopper-examples'

if open:
    webbrowser.open(url, new=2)
# ---------- end python ----------
