# Grasshopper definition doc_list_placed_component_names.ghx (Grasshopper 1.0.7)

# List all placed Component's names
# https://github.com/runxel/grasshopper-examples
reset = Button()
python = GhPythonScript(port=reset)  # -> uniqueCompNames, uniqueCompNicks, uniqueCompTypes
# ---------- python: Python ----------
"""
Display the unique names, nicknames, and types of all components 
currently placed in the document.

Example:
    Name: Twisted Box
    Nick: TBox
    Type: SquishyXMorphs.Component_CreateTwistedBox
This is useful, if you e.g. want to use a node in code via
import ghpythonlib.components as ghc
ghc.<compName>
where <compName> is the last part of the type
(mostly after the underscore)

"""
# see https://discourse.mcneel.com/t/unique-list-of-components-in-code/73464/4

import Grasshopper as gh

uniqueCompNames = []
uniqueCompTypes = []
uniqueCompNicks = []

for obj in ghenv.Component.OnPingDocument().Objects:
    if isinstance(obj, gh.Kernel.GH_Component):
        objName = obj.Name
        objString = obj.ToString()
        objNick = obj.NickName
        
        # If you want to list more
        # check all available attributes with
        ##print dir(obj)
        
        if objName not in uniqueCompNames:
            uniqueCompNames.append(objName)
            uniqueCompTypes.append(objString)
            uniqueCompNicks.append(objNick)
# ---------- end python ----------
names = Panel(python.uniqueCompNames)
visit_the_website = Button()
nicknames = Panel(python.uniqueCompNicks)
orib = OpenRepoInBrowser(open=visit_the_website)
types = Panel(python.uniqueCompTypes)

kscope = Kaleidoscope(Plane=PlaneXY(0, 0, 0), Segments=10)  # -> Geometry, Transform; disabled
matrix = ConstructMatrix(Rows=3, Columns=3)  # disabled
partition = PartitionList(Size=[3, 2])  # disabled
srf4pt = _4PointSurface()  # disabled
tbox = TwistedBox()  # disabled

# ==== cluster OpenRepoInBrowser
open = ClusterInput()
python = GhPythonScript(open=open)
# ---------- python: Python ----------
""" A simple 'open in browser' script """

import webbrowser

url = 'https://github.com/runxel/grasshopper-examples'

if open:
    webbrowser.open(url, new=2)
# ---------- end python ----------
