# Grasshopper definition doc_metadata_py.ghx (Grasshopper 1.0.7)
# plug-ins: MeshEdit Components, Human, Kangaroo2 Components
# A brief description.

# GhPython Metadata
# https://github.com/runxel/grasshopper-examples
boolean_toggle = BooleanToggle(True)
python = GhPythonScript(run=boolean_toggle, run_env=Toggle(True))  # -> fileName, filePath, description, author, cdate, ctime, rev, ghVersion, funcCore, funcAdd
# ---------- python: Python ----------
"""
Displays Grasshoppers document metadata.

    Args:
        run:        Determine if the code runs. Should be set to true all times.
        run_env:    Runs version and add-ons check. Set to true to update.
    Returns:
        fileName:   Name of Grasshopper document.
        filePath:   Location of the doc.
        description: Description of the document's properties.
        author:     File creator name.
        cdate:      Creation date
        ctime:      Creation time
        rev:        Revision count. For details see File > Document Properties... > Revisions
        ghVersion:  Grasshopper version number.
        funcCore:   Lists the core modules of all nodes placed.
        funcAdd:    Lists any add-ons of which are nodes placed.
"""

# References:
# https://www.grasshopper3d.com/forum/topics/gh-filename-is-python?commentId=2985220%3AComment%3A1093760&xg_raw_resources=1
# https://www.grasshopper3d.com/forum/topics/pulling-grasshopper-metadata-document-properties


import Grasshopper as gh

def libraries():
    coreLibraries = {}
    addonLibraries = {}
    objids = {}
    
    server = gh.Instances.ComponentServer
    for obj in ghenv.Component.OnPingDocument().Objects:
        if obj == ghenv.Component: continue # Ignore this component.
        
        objId = obj.ComponentGuid
        if objids.has_key(objId): continue
        objids[objId] = ""
        
        lib = server.FindAssemblyByObject(obj)
        if lib == None: continue
        if coreLibraries.has_key(lib.Id) or addonLibraries.has_key(lib.Id): continue
        
        if lib.IsCoreLibrary:
            coreLibraries[lib.Id] = lib
        else:
            addonLibraries[lib.Id] = lib
    
    return coreLibraries, addonLibraries


if run:
    file = ghdoc.Name
    path = ghdoc.Path
    if "unnamed" in file:
        # File has not been saved yet!
        fileName = "File has not been saved yet!"
        filePath = ""
    else:
        fileName = "File name: {}".format(file)
        filePath = "File path: {}".format(path)

    description = ghenv.Component.OnPingDocument().Properties.Description

    auth = gh.CentralSettings.AuthorName
    author = "Author of file: {}".format(auth)

    dt = ghenv.Component.OnPingDocument().Properties.Date
    # returns a DateTime object – which is *NOT* the
    # native python datetime, but .NET's DateTime
    # (since it's IronPython) and we map to .NET types
    # see https://docs.microsoft.com/de-de/dotnet/api/system.datetime?view=netcore-3.1#properties for more info
    # A direct "print .." would result in a slightly weird string however.
    # e.g. 09/19/2020 14:50:23
    # So you either convert to a native Python datetime object
    # or you just build the strings by hand.
    # Beware: .NET datetime is never zero padded, so you have to left pad yourself!
    cdate = "Creation Date: {}-{:02d}-{:02d}".format(dt.Year, dt.Month, dt.Day)
    ctime = "Creation Time: {:02d}:{:02d}".format(dt.Hour, dt.Minute)

    revnum = ghenv.Component.Attributes.Owner.OnPingDocument().Properties.Revisions.Count
    rev = "Revision count: {}".format(revnum)


if run_env:
    ghv = gh.Versioning.Version
    ghVersion = "Grasshopper version running: {}".format(ghv)
    
    # query the function
    coreLibraries, addonLibraries = libraries()
    
    funcCore, funcAdd = [], []
    for id, lib in coreLibraries.iteritems():
        funcCore.append("{} {}".format(lib.Name, lib.Version))
    
    for id, lib in addonLibraries.iteritems():
        funcAdd.append("{} {}".format(lib.Name, lib.Version))
# ---------- end python ----------
panel = Panel(python.fileName)
panel_2 = Panel(python.filePath)
panel_3 = Panel(python.description)
panel_4 = Panel(python.author)
panel_5 = Panel(python.cdate)
panel_6 = Panel(python.ctime)
panel_7 = Panel(python.rev)
panel_8 = Panel(python.ghVersion)
panel_9 = Panel(python.funcCore)
visit_the_website = Button()
panel_10 = Panel(python.funcAdd)
orib = OpenRepoInBrowser(open=visit_the_website)

item = CherryPicker(ListIndex=0)  # disabled
bake = BakeGeometry(Bake=False, DeleteOldBakes=False, PreserveTrees=False)  # disabled
show = Show()  # disabled
preview = CustomPreview(Material={diffuse=RGB(221, 160, 221), emission=RGB(66, 48, 66), shine=0.5, specular=RGB(255, 255, 255), transparency=0})  # disabled
area = MeshArea()  # -> Area, Centroid; disabled
addition = Addition()  # disabled
divide = DivideCurve(Count=10, Kinks=False)  # -> Points, Tangents, Parameters; disabled

# ==== cluster OpenRepoInBrowser
open = ClusterInput()
python = GhPythonScript(open=open)
# ---------- python: Python ----------
""" A simple 'open in browser' script """

import webbrowser

url = 'https://github.com/runxel/grasshopper-examples'

if open:
    webbrowser.open(url, new=2)
# ---------- end python ----------
