# Grasshopper definition doom_fire.ghx (Grasshopper 1.0.7)

# Doom Fire
# https://github.com/runxel/grasshopper-examples
# http://www.fabiensanglard.net/doom_fire_psx/
size_x = Slider(36, range=2..64)
size_y = Slider(38, range=36..64)
reset = Button()
doom_y_or_custom = BooleanToggle(True)
bg_color = ColourSwatch(SwatchColor=RGB(0, 0, 0))
series = Series(Start=0, Step=1, Count=37)
# Original Doom
# Fire Gradient
colour_swatch = ColourSwatch(SwatchColor=RGB(199, 71, 7))
gradient = Gradient(
    LowerLimit=0,
    UpperLimit=36,
    Parameter=series,
    stops=[0: RGB(255, 0, 0), 0.12: RGB(210, 0, 118), 0.276: RGB(103, 0, 120), 0.382: RGB(39, 72, 161), 0.532: RGB(1, 192, 229), 0.606: RGB(18, 178, 90), 0.718: RGB(79, 186, 8), 0.818: RGB(220, 237, 32), 0.902: RGB(255, 128, 0)])
merge = Merge(
    Data1=ColourSwatch(SwatchColor=RGB(7, 7, 7)),
    Data2=ColourSwatch(SwatchColor=RGB(31, 7, 7)),
    Data3=ColourSwatch(SwatchColor=RGB(47, 15, 7)),
    Data4=ColourSwatch(SwatchColor=RGB(71, 15, 7)),
    Data5=ColourSwatch(SwatchColor=RGB(87, 23, 7)),
    Data6=ColourSwatch(SwatchColor=RGB(103, 31, 7)),
    Data7=ColourSwatch(SwatchColor=RGB(119, 31, 7)),
    Data8=ColourSwatch(SwatchColor=RGB(143, 39, 7)),
    Data9=ColourSwatch(SwatchColor=RGB(159, 47, 7)),
    Data10=ColourSwatch(SwatchColor=RGB(175, 63, 7)),
    Data11=ColourSwatch(SwatchColor=RGB(191, 71, 7)),
    Data12=colour_swatch,
    Data13=ColourSwatch(SwatchColor=RGB(223, 79, 7)),
    Data14=ColourSwatch(SwatchColor=RGB(223, 87, 7)),
    Data15=ColourSwatch(SwatchColor=RGB(223, 87, 7)),
    Data16=ColourSwatch(SwatchColor=RGB(215, 95, 7)),
    Data17=ColourSwatch(SwatchColor=RGB(215, 103, 15)),
    Data18=ColourSwatch(SwatchColor=RGB(207, 111, 15)),
    Data19=ColourSwatch(SwatchColor=RGB(207, 119, 15)),
    Data20=ColourSwatch(SwatchColor=RGB(207, 127, 15)),
    Data21=ColourSwatch(SwatchColor=RGB(207, 135, 23)),
    Data22=ColourSwatch(SwatchColor=RGB(199, 135, 23)),
    Data23=ColourSwatch(SwatchColor=RGB(199, 143, 23)),
    Data24=ColourSwatch(SwatchColor=RGB(199, 135, 23)),
    Data25=ColourSwatch(SwatchColor=RGB(199, 143, 23)),
    Data26=ColourSwatch(SwatchColor=RGB(199, 151, 31)),
    Data27=ColourSwatch(SwatchColor=RGB(191, 159, 31)),
    Data28=ColourSwatch(SwatchColor=RGB(191, 167, 39)),
    Data29=ColourSwatch(SwatchColor=RGB(191, 175, 47)),
    Data30=ColourSwatch(SwatchColor=RGB(183, 175, 47)),
    Data31=ColourSwatch(SwatchColor=RGB(183, 183, 47)),
    Data32=ColourSwatch(SwatchColor=RGB(183, 183, 55)),
    Data33=ColourSwatch(SwatchColor=RGB(207, 207, 111)),
    Data34=ColourSwatch(SwatchColor=RGB(223, 223, 159)),
    Data35=ColourSwatch(SwatchColor=RGB(239, 239, 199)),
    Data36=ColourSwatch(SwatchColor=RGB(255, 255, 255)))
col = Colour(merge)
visit_the_website = Button()

# ---- group: GRID
sqgrid = Square(Plane=PlaneXY(0, 0, 0), Size=1, ExtentX=size_x, ExtentY=size_y)  # -> Cells, Points
suirify = Suirify(sqgrid.Cells)
flip = FlipMatrix(Data=suirify)
boundary = BoundarySurfaces(Edges=flip)  # disabled

# ----
filter = StreamFilter(Gate=doom_y_or_custom, Stream0=gradient, Stream1=col)
orib = OpenRepoInBrowser(open=visit_the_website)
python = GhPythonScript(sizeX=size_x, sizeY=size_y, reset=reset, colorPalette=filter, bgCol=bg_color)  # -> out, color; inputs sizeX: Int32, sizeY: Int32, reset: Boolean, colorPalette: list of Color, bgCol: Color
# ---------- python: Python ----------
"""
This mimicks the flames animation from DOOM.
It's based on http://www.fabiensanglard.net/doom_fire_psx/
"""

############# libs ################
import Rhino.Geometry as rg
import rhinoscriptsyntax as rs
import ghpythonlib.treehelpers as th
import random

FIRE_HEIGHT = sizeY
FIRE_WIDTH  = sizeX


def setup():
    for y in range(FIRE_HEIGHT):
        tempCol = []
        for _ in range(FIRE_WIDTH):
            # set bottom line to be white, last item in list
            if y == 0:
                tempCol.append(colorPalette[len(colorPalette)-1])
            else:
                # backgroundcolor (full black)
                tempCol.append(bgCol)
        pxlColor.append(tempCol)


def spreadFire(srcY, srcX):
    newCol = len(colorPalette)-1 -srcY - random.randint(0, 3)
    # prevent negative indices
    newCol = 0 if newCol < 0 else newCol
    # prevent out of bounds
    while True:
        changeY = srcY + random.randint(-1, 1)
        if 0 <= changeY < FIRE_HEIGHT:
            break
    while True:
        changeX = srcX + random.randint(-2, 2)
        if 0 <= changeX < FIRE_WIDTH:
            break
    pxlColor[changeY][changeX] = colorPalette[newCol]


def doFire():
    y = 1
    for y in range(FIRE_HEIGHT):
        for x in range(FIRE_WIDTH):
            spreadFire(y, x)


if "pxlColor" not in globals() or reset == True:
    # if not yet created, make it
    # so we can now make use of the timer
    # without this trick the colors would not be persistent
    pxlColor = []
    setup()
doFire()

_color = th.list_to_tree(pxlColor)
# ---------- end python ----------
# Activate me!
timer = Timer(TimerInterval=30, Target=python)  # disabled
# Baked and rereferenced for better perf.
geo = Geometry(Tree({0}: [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], {1}: [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], {2}: [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], {3}: [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], {4}: [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], {5}: [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]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))
panel = Panel(python.color)
preview = CustomPreview(Geometry=geo, Material=python.color)

# ==== cluster OpenRepoInBrowser
open = ClusterInput()
python = GhPythonScript(open=open)
# ---------- python: Python ----------
""" A simple 'open in browser' script """

import webbrowser

url = 'https://github.com/runxel/grasshopper-examples'

if open:
    webbrowser.open(url, new=2)
# ---------- end python ----------
