# Grasshopper definition find_panel_change_content.ghx (Grasshopper 1.0.7)

# Beware! This is no undoable action!
set_content_of_named_panels = Button()
panel = Panel("""Test
Qux
GH""")
reset = Button()
# Find Panels by their Name and change it's Contents
# https://github.com/runxel/grasshopper-examples
test = Panel("12345")
qux = Panel("Foobar")
gh = Panel("Rhino")
python = PythonScript(port=reset, Set=set_content_of_named_panels, Panels=panel, Input="Hi!")  # -> panelname, panelguid, panelvalue; inputs Set: Boolean, Panels: list
# ---------- python: Python ----------
import Grasshopper as gh

ghc = ghenv.Component
ghDoc = ghc.OnPingDocument()
ghObjects = ghDoc.Objects

panelname = []
panelvalue = []
panelguid = []

for obj in ghObjects:
    if type(obj) is gh.Kernel.Special.GH_Panel:
        if obj.NickName in Panels:
            name = obj.NickName
            panelname.append(name)
            
            guid = obj.InstanceGuid
            panelguid.append(str(guid))
            
            value = obj.UserText
            panelvalue.append(value)
            
            if Set:
                if Input is None:
                    # This changes all the panels to have the same text
                    obj.SetUserText("No input was given.")
                else:
                    obj.SetUserText(Input)
                    obj.ExpireSolution(True)
# ---------- end python ----------
visit_the_website = Button()
# Panel GUIDs
panel_2 = Panel(python.panelguid)
# Panel contents
panel_3 = Panel(python.panelvalue)
# Panel Names
panel_4 = Panel(python.panelname)
