# Grasshopper definition flatten_lists.ghx (Grasshopper 1.0.7)

# List Access!
data = Data(Tree({0;0}: ["2", "4", "6"], {0;1}: ["10", "20"], {0;2}: ["200", "100", "50", "25", "5"]))
# Flatten Lists
# https://github.com/runxel/grasshopper-examples
panel = Panel(data)
python = PythonScript(dataTree1=data, dataTree2=data)  # -> a, b; inputs dataTree1: tree, dataTree2: tree
# ---------- python: Python ----------
"""
Flatten lists in Python.
"""

from Grasshopper.Kernel.Data import GH_Path

# construct a specific output path
flattenPath = GH_Path(4,102,60)

dataTree1.Flatten(flattenPath)
dataTree2.Flatten()

a = dataTree1
b = dataTree2
# ---------- end python ----------
visit_the_website = Button()
panel_2 = Panel(python.a)
panel_3 = Panel(python.b)
