# Grasshopper definition generating_hatch_in_active_rhinodoc.ghx (Grasshopper 1.0.7)

# Making a Hatch inside the current RhinoDoc
# https://github.com/runxel/grasshopper-examples
bake = BooleanToggle(False)
python_script = PythonScript(active=bake)
# ---------- python_script: Python ----------
"""
Making a hatch directly inside the RhinoDoc.
"""

import Rhino.Geometry as rg
import Rhino.RhinoDoc as RhinoDocument

if active:
    circle = rg.Circle(rg.Plane.WorldXY, 10)
    curvelist = []
    curvelist.append(rg.ArcCurve(circle))
    hatch = rg.Hatch.Create(curvelist, 0, 0, 1)
    
    for h in hatch:
        RhinoDocument.ActiveDoc.Objects.Add(h)
# ---------- end python_script ----------
visit_the_website = Button()
