# Grasshopper definition get_degree_of_curve.ghx (Grasshopper 1.0.7)

# Get Degree of Curve
# https://github.com/runxel/grasshopper-examples
pt = Point([Point(4.930702472, 60.77937057, 0), Point(-9.444118121, 45.76126508, 0), Point(15.17435008, 44.05588276, 0), Point(-14.1084129, 27.69622957, 0), Point(15.91924191, 28.51269633, 0), Point(-4.388125613, 15.32404491, 0), Point(20.60202693, 15.81052372, 0), Point(11.46244347, 3.315397111, 0), Point(27.84930025, 8.061876149, 0), Point(21.44819001, -4.545934346, 0), Point(34.77570803, 0.3390679898, 0), Point(33.48952986, -10.95827517, 0), Point(45.77239341, -5.652696091, 0), Point(44.1836328, -15.72071574, 0), Point(54.48778981, -4.63929372, 0), Point(59.38725088, -13.78655226, 0), Point(62.28261457, 3.824216262, 0), Point(77.24516999, -7.499647149, 0), Point(75.38686546, 9.341823618, 0)])
series = Series(Start=1, Step=1, Count=10)
crv = NurbsCurve(Vertices=pt, Degree=series, Periodic=False)  # -> Curve, Length, Domain
python = GhPythonScript(crv=crv.Curve)  # -> a; inputs crv: Curve
# ---------- python: Python ----------
dg = crv.Degree

a = "Degree = {}".format(dg)
# ---------- end python ----------
panel = Panel(python)
visit_the_website = Button()
orib = OpenRepoInBrowser(open=visit_the_website)

# ==== cluster OpenRepoInBrowser
open = ClusterInput()
python = GhPythonScript(open=open)
# ---------- python: Python ----------
""" A simple 'open in browser' script """

import webbrowser

url = 'https://github.com/runxel/grasshopper-examples'

if open:
    webbrowser.open(url, new=2)
# ---------- end python ----------
