# Grasshopper definition gh_component_in_code.ghx (Grasshopper 1.0.7)

# Node in code
# https://github.com/runxel/grasshopper-examples
pt = Point([Point(-12.82153116, 6.82558876, 0), Point(3.994255934, 9.864586428, 0), Point(11.89564987, 1.35539296, 0), Point(14.12424816, -7.559000198, 0), Point(14.93464754, -10.59799786, 0), Point(5.412454845, -12.01619678, 0), Point(-2.894138778, -12.82659615, 0), Point(-10.18773318, -0.4680056407, 0), Point(-24.77492198, -11.40839724, 0), Point(-9.985133335, -6.140801286, 0), Point(1.5630578, 2.976191715, 0), Point(10.47745096, -4.317402686, 0), Point(25.87503914, 2.368392182, 0), Point(23.03864131, 9.459386739, 0), Point(4.804655312, -7.761600042, 0), Point(-14.64492976, -16.47339335, 0), Point(-7.786, 0, 0)])
python = PythonScript(points=pt)  # -> curves, areas, max_area, max_curve; inputs points: list of Point3d
# ---------- python: Python ----------
"""
Use Grasshopper components in Python code.

"""

import ghpythonlib.components as ghc

curves = ghc.Voronoi(points)
areas = ghc.Area(curves).area

# find the biggest curve in the set
max_area = -1
max_curve = None

for i, curve in enumerate(curves):
    if areas[i] > max_area:
        max_area = areas[i]
        max_curve = curve
# ---------- end python ----------
panel = Panel(python.areas)
crv = Curve(python.max_curve)
panel_2 = Panel(python.curves)
panel_3 = Panel(python.max_area)
visit_the_website = Button()
preview = CustomPreview(
    Geometry=crv,
    Material={diffuse=RGB(220, 20, 60), emission=RGB(66, 48, 66), shine=0.5, specular=RGB(255, 255, 255), transparency=0})
orib = OpenRepoInBrowser(open=visit_the_website)

# ==== cluster OpenRepoInBrowser
open = ClusterInput()
python = GhPythonScript(open=open)
# ---------- python: Python ----------
""" A simple 'open in browser' script """

import webbrowser

url = 'https://github.com/runxel/grasshopper-examples'

if open:
    webbrowser.open(url, new=2)
# ---------- end python ----------
