# Grasshopper definition meta_change_grasshopper_canvas_color.ghx (Grasshopper 1.0.7)

# (Meta) Change the Color of the GH Canvas
# https://github.com/runxel/grasshopper-examples
# This comes in handy if you want to take screenshots e.g.
background = ColourSwatch(SwatchColor=RGB(255, 255, 255))
grid = ColourSwatch(SwatchColor=RGB(255, 255, 255))
python = GhPythonScript(switch=Toggle(False), canvas_back=background, canvas_grid=grid)  # inputs switch: Boolean, canvas_back: Color, canvas_grid: Color
# ---------- python: Python ----------
"""
Change GH canvas color.
"""

import Grasshopper
import rhinoscriptsyntax as rs

# https://developer.rhino3d.com/guides/rhinopython/python-rhinoscriptsyntax-color/

if switch:
    Grasshopper.GUI.Canvas.GH_Skin.canvas_back = canvas_back
    Grasshopper.GUI.Canvas.GH_Skin.canvas_grid = canvas_grid
    Grasshopper.GUI.Canvas.GH_Skin.canvas_edge = rs.CreateColor(0, 0, 0)
    Grasshopper.GUI.Canvas.GH_Skin.canvas_shade = rs.CreateColor(0, 0, 0, 80)
else:
    # DEFAULTS
    Grasshopper.GUI.Canvas.GH_Skin.canvas_grid = rs.CreateColor(0, 0, 0, 30)
    Grasshopper.GUI.Canvas.GH_Skin.canvas_back = rs.CreateColor(212, 208, 200)
    Grasshopper.GUI.Canvas.GH_Skin.canvas_edge = rs.CreateColor(0, 0, 0)
    Grasshopper.GUI.Canvas.GH_Skin.canvas_shade = rs.CreateColor(0, 0, 0, 80)
# ---------- end python ----------
visit_the_website = Button()
orib = OpenRepoInBrowser(open=visit_the_website)

# ==== cluster OpenRepoInBrowser
open = ClusterInput()
python = GhPythonScript(open=open)
# ---------- python: Python ----------
""" A simple 'open in browser' script """

import webbrowser

url = 'https://github.com/runxel/grasshopper-examples'

if open:
    webbrowser.open(url, new=2)
# ---------- end python ----------
