# Grasshopper definition naive_looping_scriptcontext.ghx (Grasshopper 1.0.7)

# ----
# Naive Looping with Python
# https://github.com/runxel/grasshopper-examples
# Original posted at the now defunct:
# 
# https://atelierpanda.squarespace.com/thoughts/elierbinturong.com/2012/09/a-workaround-for-iteration-in.html
# #1
clear = BooleanToggle(False)
python = PythonScript(clear=clear)
# ---------- python: Python ----------
import scriptcontext as sc

if clear:
    sc.sticky.clear()
else:
    sc.sticky["outputs"] = None
# ---------- end python ----------

# ----
# Step through the loop
step = Button()
rec = DataRecorder(step, DataLimit=-10, RecordData=True)
int = Integer(-1)
lng = ListLength(List=flatten([rec, int]))  # -> expr("Max(0, (x-1)\2)", Length)
panel = Panel(lng)

crv = Curve(<curve referenced from the Rhino model>)
sliderrot = Slider(75.2, range=0..90)
visit_the_website = Button()

# ----
# #2
run = BooleanToggle(True)
python_2 = PythonScript(run=run, initial_input=crv, loop_tick=lng, num_loops="100")  # -> a; inputs loop_tick: Int32
# ---------- python_2: Python ----------
import scriptcontext as sc

if run:
    if loop_tick == 0:
        # clear the sticky["outputs"]
        sc.sticky["outputs"] = [None] * int(num_loops)
        a = initial_input
    elif sc.sticky["outputs"][int(loop_tick - 1)] is not None:
        a = sc.sticky["outputs"][int(loop_tick - 1)]
else:
    a = None
# ---------- end python_2 ----------

orib = OpenRepoInBrowser(open=visit_the_website)
crv_2 = Curve(python_2)

rad = Radians(Degrees=sliderrot)
end = EndPoints(Curve=crv_2)  # -> Start, End
xy = XYPlane(Origin=end.End)
vec2pt = Vector2Pt(PointA=end.Start, PointB=end.End, Unitize=False)  # -> Vector, Length
rot3d = Rotate3D(Geometry=crv_2, Angle=rad, Center=end.Start, Axis=Vector(0, 0, 1))  # -> Geometry, Transform
move = Move(Geometry=rot3d.Geometry, Motion=vec2pt.Vector)  # -> Geometry, Transform

# ---- group: Preview Angle
align = AlignPlane(Plane=xy, Direction=vec2pt.Vector)  # -> Plane, Angle
subtraction = Subtraction(A=" pi", B=rad)
prot = RotatePlane(Plane=align.Plane, Angle=rad)
arc = Arc(Plane=prot, Radius=1, Angle=subtraction)  # -> Arc, Length
deg = Degrees(Radians=subtraction)
tag = TextTag(Location=prot, Text=deg, Colour=ColourSwatch(SwatchColor=RGB(0, 0, 0)))

# ----
crv_3 = Curve(move.Geometry)

# ----
# #3
python_3 = PythonScript(run=run, output=crv_3, loop_tick=lng)  # -> a; inputs output: GeometryBase, loop_tick: Int32
# ---------- python_3: Python ----------
import scriptcontext as sc

if run:
    # add initial input to list in dictionary
    if output is not None:
        sc.sticky["outputs"][int(loop_tick)] = output
a = sc.sticky["outputs"]
# ---------- end python_3 ----------

preview = CustomPreview(Geometry=python_3, Shader=ColourSwatch(SwatchColor=RGB(0, 0, 0)))

# ==== cluster OpenRepoInBrowser
open = ClusterInput()
python = GhPythonScript(open=open)
# ---------- python: Python ----------
""" A simple 'open in browser' script """

import webbrowser

url = 'https://github.com/runxel/grasshopper-examples'

if open:
    webbrowser.open(url, new=2)
# ---------- end python ----------
