# Grasshopper definition parallel_executing.ghx (Grasshopper 1.0.7)

# Parallel Executing of GH components inside Python
# https://github.com/runxel/grasshopper-examples
number_slider = Slider(100, range=-2..301)
angle = Slider(3.14, range=0..3.14)
pln = Plane(Plane(origin=(0.2632313765, 0, 0.3624400276), x=(0.898216722, 0, 0.439552864), y=(-0.3566800281, 0.5844065075, 0.7288678835)))
sph = Sphere(Base=PlaneXY(0, 0, 0), Radius=20)
arrpolar = PolarArray(Geometry=pln, Plane=PlaneXY(0, 0, 0), Count=number_slider, Angle=angle)  # -> Geometry, Transform
visit_the_website = Button()
python = PythonScript(planes=arrpolar.Geometry, brep=sph, parallel=Toggle(True))  # -> slices; inputs planes: list of Plane, brep: Brep
# ---------- python: Python ----------
"""
Demonstrating how to execute GH components
parallel in Python.
"""

import ghpythonlib.components as ghcomp
import ghpythonlib.parallel

# custom function that is executed by parallel.run
def slice_at_angle(plane):
    result = ghcomp.BrepXPlane(brep, plane)
    if result: return result.curves

if parallel:
    slices = ghpythonlib.parallel.run(slice_at_angle, planes, True)
else:
    slices = ghcomp.BrepXPlane(brep, planes).curves
# ---------- end python ----------
# These do the same thing
sec = BrepPlane(Brep=sph, Plane=arrpolar.Geometry)  # -> Curves, Points
panel = Panel(python)
