# Grasshopper definition poisson_disk_sampling.ghx (Grasshopper 1.0.7)

# Poisson disk sampling
# https://github.com/runxel/grasshopper-examples
# A component that will generate random points that preserve minimum distance from each other (the usual GH random points take quantity, not distance)
number_slider = Slider(30, range=10..50)
R = Slider(4, range=0.25..5)
seed = Slider(25, range=0..100)
python = GhPythonScript(width=number_slider, height=number_slider, min_distance=R, max_tries=Slider(25, range=1..100), seed=seed)  # -> out, ret; inputs width: Int32, height: Int32, max_tries: Int32, seed: Int32
# ---------- python: Python ----------
import random
import math
from Rhino import Geometry


def pdist(p1, p2):
    # where p is (x,y)
    return math.sqrt((p2[0] - p1[0])**2 + (p2[1] - p1[1])**2)


def poisson_disk_sampling(width, height, min_distance, max_tries):
    points = []  # list of points
    active_points = []  # list of points that still need to be checked

    # choose a random point as the starting point
    first_point = (random.uniform(0, width), random.uniform(0, height))
    points.append(first_point)
    active_points.append(first_point)

    while active_points:
        # choose a random active point
        i = random.randint(0, len(active_points) - 1)
        point = active_points[i]

        # generate up to max_tries points that are at least min_distance
        # away from all existing points
        for _ in range(max_tries):
            angle = random.uniform(0, 2 * math.pi)
            distance = random.uniform(min_distance, 2 * min_distance)
            new_point = (point[0] + distance * math.cos(angle),
                         point[1] + distance * math.sin(angle))

            # check if the new point is within the region
            if (new_point[0] >= 0 and new_point[0] < width and
                new_point[1] >= 0 and new_point[1] < height and
                all(pdist(new_point, p) >= min_distance for p in points)):
                points.append(new_point)
                active_points.append(new_point)
                break
        else:
            # if we couldn't find a suitable point, remove the active point
            # from the list
            active_points.pop(i)

    return points


ptlist = poisson_disk_sampling(width, height, min_distance, max_tries)

ret = [Geometry.Point3d(point[0], point[1], 0) for point in ptlist]
# ---------- end python ----------
rectangle = Rectangle(Plane=PlaneXY(0, 0, 0), XSize=number_slider, YSize=number_slider, Radius=0)  # -> Rectangle, Length
division = Division(A=R, B=2)
crv = Curve(rectangle.Rectangle)
del = DelaunayMesh(Points=python.ret, Plane=PlaneXY(0, 0, 0))
cir = Circle(Plane=python.ret, Radius=division)
medges = MeshEdges(Mesh=del)  # -> NakedEdges, InteriorEdges, NonManifoldEdges
lines = ColourSwatch(SwatchColor=RGB(46, 227, 255))
preview = CustomPreview(Geometry=[medges.NakedEdges, medges.InteriorEdges], Material=lines)
