# Grasshopper definition python_list_to_grasshopper_tree.ghx (Grasshopper 1.0.7)

python = PythonScript()  # -> out, list
# ---------- python: Python ----------
list = [1,[2,3],[1,[10,11,12],3],[1,2,3],[1,2,3]]
print list
# ---------- end python ----------
# Python List to Grasshopper Tree
# https://github.com/runxel/grasshopper-examples
panel = Panel(python.out)

# ---- group: With GH_Path module
pylist2tree = PythonListToGrasshopperTree(list=python.list)  # -> out, tree_out; inputs list: list
# ---------- pylist2tree: Python ----------
"""
Python List to Grasshopper Tree

Takes a nested Python list and outputs a corresponding GH Tree with
each list element on the right branch.
Works with as many nested levels as needed.
"""

import collections
from Grasshopper import DataTree
from Grasshopper.Kernel.Data import GH_Path

ghenv.Component.Name = "Python List to Grasshopper Tree"
ghenv.Component.NickName = "pyList2Tree"


def unpackList(lst, path=GH_Path(0)):
    tree = DataTree[object]()
    
    for elem in lst:
        
        if isinstance(elem, collections.Iterable):
            tree.MergeTree(unpackList(elem,path.AppendElement(0)))
        else:
            print(path)
            tree.Add(elem,path)
        path = path.Increment(-1)
    return tree


tree_out = unpackList(list)
# ---------- end pylist2tree ----------

# ---- group: With GH treehelpers module
python_2 = GhPythonScript(list=python.list)  # -> tree_out; inputs list: list
# ---------- python_2: Python ----------
"""
With GH's treehelpers
"""

import ghpythonlib.treehelpers as th

tree_out = th.list_to_tree(list, False)
# ---------- end python_2 ----------

# ----
visit_the_website = Button()
path = Panel(pylist2tree.tree_out)
tree_statistics_paths = Panel(pylist2tree.out)
viewer = ParamViewer(pylist2tree.tree_out)
treehelper = Panel(python_2)

# ---- group: Making the Python output similar too the treehelpers output
path_mapper = PathMapper(pylist2tree.tree_out, source=["{A}(i)", "{A;B}", "{A;B;C}"], target=["{A;i}", "{A;B}", "{A;B;C}"])
trim = TrimTree(Tree=path_mapper, Depth=1)
panel_2 = Panel(trim)
