# Grasshopper definition python_paths.ghx (Grasshopper 1.0.7)

# Python paths
# https://github.com/runxel/grasshopper-examples
# Additional path
# with libraries etc.
path = FilePath("C:\Users\Lucas\Desktop\")
python = GhPythonScript(x=path)  # -> p
# ---------- python: Python ----------
"""
Dislay the places, where Python will look for additional
libraries etc.
"""

import sys

# you can append to sys.path like with every other list
sys.path.append(x)

p = sys.path
# ---------- end python ----------
panel = Panel(python)
visit_the_website = Button()
orib = OpenRepoInBrowser(open=visit_the_website)

# ==== cluster OpenRepoInBrowser
open = ClusterInput()
python = GhPythonScript(open=open)
# ---------- python: Python ----------
""" A simple 'open in browser' script """

import webbrowser

url = 'https://github.com/runxel/grasshopper-examples'

if open:
    webbrowser.open(url, new=2)
# ---------- end python ----------
