# Grasshopper definition quad_tree_pseudo.ghx (Grasshopper 1.0.7)

# Draw Pseudo Quadtree
# https://github.com/runxel/grasshopper-examples
number_slider = Slider(10, range=0..10)
max_recursion_level = Slider(9, range=2..10)
seed = Slider(507, range=0..1000)
python = GhPythonScript(initSize=number_slider, maxRecLvl=max_recursion_level, seed=seed)  # -> node; inputs maxRecLvl: Int32
# ---------- python: Python ----------
"""
Draws a faux QuadTree.
The mistake is easy to spot:
Real QuadTrees subdivide equally, here it doesn't.
"""

import Rhino.Geometry as rg
import random

if not maxRecLvl:
	maxRecLvl = 5
if maxRecLvl > 10:
	# just to limit the computation a bit
	maxRecLvl = 10

initPlane = rg.Plane.WorldXY
parts = []

def drawPart(c, p, rLvl):
	# rect gives the size of the node
	# p = Plane,  rLvl = recusion depth
	if rLvl != 0:
		quad = c*0.5
		halfquad = quad*0.5
		Invl = rg.Interval(-quad, quad)
		# now the actual rectangle

		parts.append(rg.Rectangle3d(p, Invl, Invl).ToNurbsCurve())

		if bool(random.getrandbits(1)):
			# top left
			olPlane = rg.Plane( rg.Point3d(p.OriginX - halfquad, p.OriginY + halfquad, 0), rg.Vector3d.ZAxis)
			drawPart(quad, olPlane, rLvl-1)

		if bool(random.getrandbits(1)):
			# top right
			orPlane = rg.Plane( rg.Point3d(p.OriginX + halfquad, p.OriginY + halfquad, 0), rg.Vector3d.ZAxis)
			drawPart(quad, orPlane, rLvl-1)

		if bool(random.getrandbits(1)):
			# bottom right
			urPlane = rg.Plane( rg.Point3d(p.OriginX + halfquad, p.OriginY - halfquad, 0), rg.Vector3d.ZAxis)
			drawPart(quad, urPlane, rLvl-1)

		if bool(random.getrandbits(1)):
			# bottom left
			ulPlane = rg.Plane( rg.Point3d(p.OriginX - halfquad, p.OriginY - halfquad, 0), rg.Vector3d.ZAxis)
			drawPart(quad, ulPlane, rLvl-1)


drawPart(initSize, initPlane, maxRecLvl)
node_ = parts
# ---------- end python ----------
visit_the_website = Button()
panel = Panel(python)
orib = OpenRepoInBrowser(open=visit_the_website)

# ==== cluster OpenRepoInBrowser
open = ClusterInput()
python = GhPythonScript(open=open)
# ---------- python: Python ----------
""" A simple 'open in browser' script """

import webbrowser

url = 'https://github.com/runxel/grasshopper-examples'

if open:
    webbrowser.open(url, new=2)
# ---------- end python ----------
