# Grasshopper definition quad_tree_random_points.ghx (Grasshopper 1.0.7)

# Draw a Quadtree with Random Points
# https://github.com/runxel/grasshopper-examples
number_slider = Slider(1, range=1..10)
npts = Slider(100, range=0..100)
reset = Button()
python = GhPythonScript(reset=reset, threshold=number_slider, nPts=npts)  # -> out, pts, qt; inputs reset: Boolean, threshold: Int32, nPts: Int32
# ---------- python: Python ----------
"""
Draw a QuadTree with a number of randomly generated points.
Idea from https://github.com/kpully/quadtree

    Args:
        reset:     Generate a new random distribution of points. 
        threshold: Defines the max number of points inside a quadtree node.
        nPts:      Number of points which shall randomly generated
    Returns:
        _pts: Randomly distributed points.
        _qt:  The quadtree as rectangles.
"""

import Rhino.Geometry as rg
import random

if threshold < 1:
    raise ValueError("Threshold must be at least 1.")

if nPts is None or nPts == 0:
    nPts = 1

#---------------------------------------------------------------
class Point(object):
    def __init__(self, x, y):
        self.x = x
        self.y = y


class Node(object):
    def __init__(self, x0, y0, w, h, points):
        self.x0 = x0
        self.y0 = y0
        self.width = w
        self.height = h
        self.points = points
        self.children = []

    def get_width(self):
        return self.width
    
    def get_height(self):
        return self.height
    
    def get_points(self):
        return self.points


class QuadTree(object):
    """ Init the quad tree.
        Inputs:
            k = Threshold, max number of points for quad segment
            n = number of points
    """
    def __init__(self, k, n):
        self.threshold = k
        self.points = [rg.Point3d(random.uniform(0, 10), random.uniform(0, 10), 0) for x in range(n)]
        self.root = Node(0, 0, 10, 10, self.points)

    def add_point(x, y):
        self.points.append(rg.Point3d(x, y, 0))
    
    def get_points(self):
        return self.points
    
    def subdivide(self):
        recursive_subdivide(self.root, self.threshold)
    
    def graph(self):
        c = find_children(self.root)
        print "Number of segments: {}".format(len(c))
        areas = set()
        for el in c:
            areas.add(el.width*el.height)
        print "Minimum segment area: %.3f units" %min(areas)
        ax = []
        for n in c:
            plane = rg.Plane(rg.Point3d(n.x0, n.y0, 0), rg.Vector3d.XAxis, rg.Vector3d.YAxis)
            ax.append(rg.Rectangle3d(plane, n.width, n.height))
        global _pts, _qt
        _pts = self.points
        _qt = ax
        return

def recursive_subdivide(node, k):
    if len(node.points) <= k:
        return
    
    w_ = float(node.width/2)
    h_ = float(node.height/2)

    p = contains(node.x0, node.y0, w_, h_, node.points)
    x1 = Node(node.x0, node.y0, w_, h_, p)
    recursive_subdivide(x1, k)

    p = contains(node.x0, node.y0+h_, w_, h_, node.points)
    x2 = Node(node.x0, node.y0+h_, w_, h_, p)
    recursive_subdivide(x2, k)

    p = contains(node.x0+w_, node.y0, w_, h_, node.points)
    x3 = Node(node.x0 + w_, node.y0, w_, h_, p)
    recursive_subdivide(x3, k)

    p = contains(node.x0+w_, node.y0+w_, w_, h_, node.points)
    x4 = Node(node.x0+w_, node.y0+h_, w_, h_, p)
    recursive_subdivide(x4, k)

    node.children = [x1, x2, x3, x4]
    
    
def contains(x, y, w, h, points):
    pts = []
    for point in points:
        if point.X >= x and point.X <= x+w and point.Y >= y and point.Y <= y+h:
            pts.append(point)
    return pts


def find_children(node):
    if not node.children:
        return [node]
    else:
        children = []
        for child in node.children:
            children += (find_children(child))
    return children


def initQT(k, n):
    qt = QuadTree(k, n)
    qt.subdivide()
    qt.graph()

initQT(threshold, nPts)
# ---------- end python ----------
visit_the_website = Button()
panel = Panel(python.out)

symsim = SymbolSimple(Style=3, Size=9, Rotation=0, Colour=ColourSwatch(SwatchColor=RGB(166, 255, 0)))
preview = CustomPreview(Geometry=python.qt, Material=ColourSwatch(SwatchColor=RGB(0, 17, 255)))
symbol = SymbolDisplay(Location=python.pts, Display=symsim)

orib = OpenRepoInBrowser(open=visit_the_website)

# ==== cluster OpenRepoInBrowser
open = ClusterInput()
python = GhPythonScript(open=open)
# ---------- python: Python ----------
""" A simple 'open in browser' script """

import webbrowser

url = 'https://github.com/runxel/grasshopper-examples'

if open:
    webbrowser.open(url, new=2)
# ---------- end python ----------
