# Grasshopper definition recursive_tree.ghx (Grasshopper 1.0.7)
# plug-ins: Human

# Recursive Tree
# https://github.com/runxel/grasshopper-examples
depth_of_recursion = Slider(8, range=1..10)
ratio = Slider(0.683, range=0.2..0.8)
angle = Slider(65, range=20..180)
# Draws a recursive Tree
python = GhPythonScript(depth=depth_of_recursion, startSize=Slider(10, range=0.5..10), nBranches=Slider(2, range=2..5), ratio=ratio, angle=angle)  # -> debug, a; inputs startPoint: Point3d, depth: Int32, nBranches: Int32
# ---------- python: Python ----------
__version__ = "2018-12-14 v1.1"

import Rhino.Geometry as rg
import Rhino.RhinoMath as rm
import ghpythonlib.treehelpers as th


# prevent endless recursion
depth = abs(depth)

if not startPoint:
    startPoint = rg.Point3d(0,0,0)

# Auffächerung
if not nBranches:
    nBranches = 2
if nBranches < 2:
    raise ValueError("Number of branches should not be less than 2.")

if not ratio:
    ratio = 0.75
if ratio <= 0 or ratio >= 1:
    raise ValueError("Ratio should be between 0 and 1")

if not angle:
    angle = 60

# calculate the rotation angle of the vectors later
# angle == total angle
rotAngle = angle / (nBranches-1)  # between branches
alpha = 180 - angle               # whats left


def drawTree(startPoint, size, vector, ratio, depth):
        
    # draw a Line and store current end point
    dtLine = rg.Line(startPoint, vector, size)
    currEndPt = dtLine.To
    tree.append(dtLine)
    
    # recursion
        
    if depth-1 >= 0:
        for n in range(nBranches):
            if n == 0:
                rg.Vector3d.Rotate(vector, rm.ToRadians(alpha/2 - 90), rg.Vector3d.ZAxis)
                lastVector = rg.Vector3d(vector)
                drawTree(currEndPt, size*ratio, vector, ratio, depth-1)
            else:
                rg.Vector3d.Rotate(lastVector, rm.ToRadians(rotAngle), rg.Vector3d.ZAxis)
                drawTree(currEndPt, size*ratio, lastVector, ratio, depth-1)
    


    return tree


startVec = rg.Vector3d.YAxis

tree = []

#### OUTPUT ####
a = drawTree(startPoint, startSize, startVec, ratio, depth)
# ---------- end python ----------
visit_the_website = Button()

line = Line(python.a)
len = Length(Curve=line)
bnd = Bounds(Numbers=len)
dedomain = DeconstructDomain(Domain=bnd)  # -> Start, End
dom = ConstructDomain(DomainStart=Slider(1.5, range=0..10), DomainEnd=Slider(13.2, range=5..20))
gradient = Gradient(
    LowerLimit=dedomain.Start,
    UpperLimit=dedomain.End,
    Parameter=len,
    stops=[0: RGB(0, 98, 0), 0.519: RGB(71, 178, 0), 0.785: RGB(128, 64, 64)])
remap = RemapNumbers(Value=len, Source=bnd, Target=dom)  # -> Mapped, Clipped
previewlw = CustomPreviewLineweights(Geometry=line, Shader=gradient, Thickness=remap.Mapped, Absolute=False)
