# Grasshopper definition rhinodoc_objects_into_grasshopper.ghx (Grasshopper 1.0.7)

# RhinoDoc Objects into GH doc (Mimicking Geometry Pipeline)
# https://github.com/runxel/grasshopper-examples
reset = Button()
python = GhPythonScript(x=reset)  # -> layers
# ---------- python: Python ----------
"""
Get all Layers in the currently active RhinoDoc.
"""

from Rhino import RhinoDoc

layers = [l.Name for l in RhinoDoc.ActiveDoc.Layers if l.IsDeleted == False]
# ---------- end python ----------
item = ListItem(List=python, Index=Slider(0, range=0..10), Wrap=True)
panel = Panel(python)
layer_name = Panel(item)
layer_name_2 = Panel("Default")
visit_the_website = Button()
reset_2 = Button()
orib = OpenRepoInBrowser(open=visit_the_website)
python_2 = PythonScript(layer=layer_name, x=reset_2)  # -> geom
# ---------- python_2: Python ----------
"""
Mimicks the behavior of the Geomtry Pipeline.
"""

import rhinoscriptsyntax as rs
import scriptcontext as sc
from Rhino import RhinoDoc

sc.doc = RhinoDoc.ActiveDoc
objects = rs.ObjectsByLayer(layer_, True)

# move all geometry to memory (in a list)
rhino_geom = [rs.coercegeometry(g) for g in objects]

# now, add all geometry to Grasshopper doc
sc.doc = ghdoc
gh_g = [sc.doc.Objects.Add(g) for g in rhino_geom]

geom = gh_g
# ---------- end python_2 ----------
geo = Geometry(python_2)
panel_2 = Panel(geo)

# ==== cluster OpenRepoInBrowser
open = ClusterInput()
python = GhPythonScript(open=open)
# ---------- python: Python ----------
""" A simple 'open in browser' script """

import webbrowser

url = 'https://github.com/runxel/grasshopper-examples'

if open:
    webbrowser.open(url, new=2)
# ---------- end python ----------
