# Grasshopper definition save_with_pickle.ghx (Grasshopper 1.0.7)

# ----
# Save anything really with Python's Pickle module
# https://github.com/runxel/grasshopper-examples
# Set folder where to save
path = FilePath()
set_a_file_name = Panel("testfile.geom")
save = Button()
retrieve = BooleanToggle(False)
geo = Geometry(Tree({0;0}: [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], {0;1}: [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]))
# NO Type hint!
# (otherwise you would just save GUIDs)
python = GhPythonScript(folder=path, filename=set_a_file_name, save=save, retrieve=retrieve, dataToSave=geo)  # -> out; inputs save: Boolean, retrieve: Boolean
# ---------- python: Python ----------
"""
Python Pickle implementation
""" """
from https://www.grasshopper3d.com/forum/topics/python-using-sticky-to-replace-wires?commentId=2985220%3AComment%3A1002528
see also:  https://docs.python.org/2/library/pickle.html#example
"""

import cPickle as pickle
from os.path import expanduser
home = expanduser("~")  # user directory

if folder is None:
    # save to Desktop
    folder = home+'\\Desktop'

# assume variable `data` holds any arbitrary data structure
file_path = folder + '/' + filename

# use a dictionary
data = {"foobar": dataToSave}

# to save data
# open in binary writing mode
if save:
    with open(file_path, 'wb') as f:
        pickle.dump(data, f)

# to retrieve saved data
# open in binary reading mode
if retrieve:
    with open(file_path, 'rb') as g: 
        # `data` will hold the data structure, completely intact, 
        # as native python types
        data = pickle.load(g) 

        # output
        _out = data["foobar"]
# ---------- end python ----------
panel = Panel(python)
geo_2 = Geometry(python)
panel_2 = Panel(geo)

visit_the_website = Button()
orib = OpenRepoInBrowser(open=visit_the_website)

# ==== cluster OpenRepoInBrowser
open = ClusterInput()
python = GhPythonScript(open=open)
# ---------- python: Python ----------
""" A simple 'open in browser' script """

import webbrowser

url = 'https://github.com/runxel/grasshopper-examples'

if open:
    webbrowser.open(url, new=2)
# ---------- end python ----------
