# Grasshopper definition select_rhino_geo_from_gh.ghx (Grasshopper 1.0.7)

pipeline = GeometryPipeline(
    GroupByLayer=False,
    GroupByType=False,
    IncludeHidden=True,
    IncludeLocked=True,
    LayerFilter="*",
    NameFilter="*",
    SublayerFiltering=True,
    TypeFilter=1)

# ---- group: For Baking
N = Slider(18, range=3..100)  # disabled
panel = Panel("0 to 1")  # disabled
# Select Rhino Geometry from Grasshopper
# https://github.com/runxel/grasshopper-examples
pt = ConstructPoint(XCoordinate=0, YCoordinate=0, ZCoordinate=0)  # disabled
box = DomainBox(Base=PlaneXY(0, 0, 0), X=panel, Y=panel, Z=panel)  # disabled
arrbox = BoxArray(Geometry=pt, Cell=box, XCount=N, YCount=N, ZCount=N)  # -> Geometry, Transform; disabled

# ----
pt_2 = Point(pipeline)
bbox = BoundingBox(Content=pt_2, Plane=PlaneXY(0, 0, 0), UnionBox=True)  # -> Box, Box_2
volume = Volume(Geometry=bbox.Box)  # -> Volume, Centroid
visit_the_website = Button()
sph = Sphere(Base=volume.Centroid, Radius=Slider(6.75, range=1..10))
brepinc = PointInBrep(Brep=sph, Point=pt_2, Strict=False)
cull = CullPattern(List=pt_2, CullPattern=brepinc)
select = Button()
python = GhPythonScript(geo=cull, select=select)  # inputs geo: Guid, select: Boolean
# ---------- python: Python ----------
""" Select referenced Rhino Geometry
    within Grasshopper.
"""
import Rhino.RhinoDoc as doc

# Typehint: "GUID"
if (select):
        doc.ActiveDoc.Objects.Select(geo)
# ---------- end python ----------
