# Grasshopper definition supershape.ghx (Grasshopper 1.0.7)

# Draw a 'Supershape' in 2D
# https://github.com/runxel/grasshopper-examples
width = Slider(4, range=0.5..10)
height = Slider(4, range=0.5..10)
number_of_rotations = Slider(4, range=1..5)
number_of_iterations = Slider(97, range=10..100)
n1 = Slider(1.1, range=0..10)
n2 = Slider(1.4, range=0..10)
n3 = Slider(2.28, range=0..10)
knob = ControlKnob(Decimals=0, Limit=True, Maximum=50, Minimum=0, Range=10, Value=33)
visit_the_website = Button()
python = GhPythonScript(width=width, height=height, nRot=number_of_rotations, nIter=number_of_iterations, n1=n1, n2=n2, n3=n3, m=knob)  # -> p; inputs nRot: Int32, nIter: Int32
# ---------- python: Python ----------
"""
Drawing a so called "Supershape".
"""

import Rhino.Geometry as rg
import math

points = []

def supershape(phi):
    t1 = abs( math.cos(_m * phi / 4) / _width)
    t1 = t1**_n2
    
    t2 = abs( math.sin(_m * phi / 4) / _height)
    t2 = t2**_n3
    
    r = (t1 + t2) ** (1/_n1)
    
    if abs(r) == 0:
        x = 0
        y = 0
    else:
        r = 1/r
        x = r * math.cos(phi)
        y = r * math.sin(phi)
    return (x, y)


for i in range(_nIter):
    phi = i * (_nRot * 2 * math.pi) / _nIter
    sp = supershape(phi)
    points.append( rg.Point3d(sp[0], sp[1], 0))

p_ = points
# ---------- end python ----------
pt = Point(python)
intcrv = Interpolate(Vertices=pt, Degree=3, Periodic=True, KnotStyle=1)  # -> Curve, Length, Domain
# https://archicad-talk.graphisoft.com/viewtopic.php?t=2084
# https://www.heise.de/newsticker/meldung/Grafik-Superformel-Ein-Kreis-ist-ein-Quadrat-ist-ein-Fisch-ist-ein-Seestern-95757.html
panel = Panel("http://paulbourke.net/geometry/supershape/")
