# Grasshopper definition surface_from_height_map.ghx (Grasshopper 1.0.7)

# Generate a Surface from a Height Map
# https://github.com/runxel/grasshopper-examples
panel = Panel("height_map.png")
grid_size = Slider(2.5, range=0..10)
scale_to_points = BooleanToggle(True)
grid_size_2 = Slider(0.2, range=0..0.2)
# If "Scale to Points" is set to true, the input image will retain its ratio and resized to the bigger X/Y size.
# Otherwise (if set to false) the image gets distorted.
rebase = Slider(0.334, range=0..1)
number_slider = Slider(43, range=0..100)
python = GhPythonScript(
    rel_file_name=panel,
    gridSize=grid_size,
    nXpts=number_slider,
    nYpts=Slider(36, range=0..100),
    scaleToPts=scale_to_points,
    multiplier=grid_size_2,
    rebase=rebase)  # -> out, grid, nmapCol; inputs nXpts: Int32, nYpts: Int32, scaleToPts: Boolean
# ---------- python: Python ----------
"""
Generate a surface from a greyscale 'height map'.
"""

import Rhino.Geometry as rg
import rhinoscriptsyntax as rs
import ghpythonlib.treehelpers as th
import System, colorsys


PtsGrid, NMapCol = [], []

# get file path of this document
GHdocFilePath = ghenv.Component.OnPingDocument().FilePath

# use it as a relative base
newFilePath = "\\".join(GHdocFilePath.split("\\")[:-1])
newFilePath = newFilePath + "\\" + rel_file_name


############# start ################
# import image file
image = System.Drawing.Bitmap(newFilePath)
origHeight = image.Height
origWidth  = image.Width

# resize image
maxVal = max(nXpts, nYpts)
minVal = min(nXpts, nYpts)
maxOrig = max(origWidth, origHeight) 
minOrig = min(origWidth, origHeight)

if scaleToPts:
    resPar = round((minOrig / maxOrig) * maxVal)
    if maxVal == nXpts:
        image = System.Drawing.Bitmap(image, nXpts, resPar)
    else:
        image = System.Drawing.Bitmap(image, resPar, nYpts)
else:               # == use Ratio
    image = System.Drawing.Bitmap(image, nXpts, nYpts)

# get current image dimensions
width  = image.Width
height = image.Height


# make the grid
# from top left corner
h = 0
for hrev in reversed(range(height)):
    tPts, tnmapc = [], []
    for j in range(width):
        
        # get pixel color, RGB
        color = image.GetPixel(j, h)
        tnmapc.append(color)

        ZValue = color.R / 255   # unitize
        if ZValue >= rebase:
            ZValue = (ZValue - rebase) * multiplier
        else:
            ZValue = (ZValue - rebase) * -multiplier


        tPts.append(rg.Point3d(j * gridSize, hrev * gridSize, ZValue*255))

    h+=1
    PtsGrid.append(tPts)
    NMapCol.append(tnmapc)


### OUTPUT ###
grid_ = th.list_to_tree(PtsGrid)
nmapCol_ = th.list_to_tree(NMapCol)
# ---------- end python ----------
visit_the_website = Button()
pt = Point(python.grid)
flip = FlipMatrix(Data=pt)
pline = PolyLine(Vertices=pt, Closed=False)  # -> flatten(Polyline)
pline_2 = PolyLine(Vertices=flip, Closed=False)  # -> flatten(Polyline)
# "False" tends to generate
# better surfaces.
srfgrid = SurfaceFromPoints(Points=flatten(pt), UCount=number_slider, Interpolate=False)
preview = CustomPreview(Geometry=pt, Material=python.nmapCol)
