# Grasshopper definition random_falloff.ghx (Grasshopper 1.0.7)
# Copyright: Copyright © 2012 Robert McNeel & Associates

line = Line(Line((2.977959734, -13.86471276, 0), (37.65332456, 58.31105, 0)))
curvepoint = PointOnCurve(line, parameter=0.365)
# Random Falloff
# https://github.com/runxel/grasshopper-examples
sqgrid = Square(Plane=PlaneXY(0, 0, 0), Size=1, ExtentX=50, ExtentY=50)  # -> Cells, flatten(Points)
colour_swatch = ColourSwatch(SwatchColor=RGB(230, 60, 105))
symsim = SymbolSimple(Style=3, Size=12, Rotation=0, Colour=colour_swatch)
lng = ListLength(List=sqgrid.Points)
dist = Distance(PointA=sqgrid.Points, PointB=curvepoint)
preview = CustomPreview(Geometry=line, Material=colour_swatch)
symbol = SymbolDisplay(Location=curvepoint, Display=symsim)
visit_the_website = Button()
random = Random(Range=Domain(0, 1), Number=lng, Seed=2)
graph = GraphMapper(
    dist,
    x0=0,
    x1=50,
    y0=0,
    y1=1,
    A=-1.880140258,
    B=0.5531423688,
    container_name="Linear",
    Graph_x0=0,
    Graph_x1=0.2942027152,
    Graph_y0=0.5531423688,
    Graph_y1=0)
graph_2 = GraphMapper(
    dist,
    x0=0,
    x1=50,
    y0=0,
    y1=1,
    A=4.848570862,
    B=-1.426462712,
    container_name="Linear",
    Graph_x0=0.47970891,
    Graph_x1=0.2942027152,
    Graph_y0=0.8994399309,
    Graph_y1=0)
graph_3 = GraphMapper(dist, x0=0, x1=50, y0=0, y1=1, Ox=0.4991618693, Oy=0, Px=0.8551763892, Py=1, container_name="Parabola")
graph_4 = GraphMapper(dist, x0=0, x1=50, y0=0, y1=1, container_name="Gaussian", factor=0.4207847714, mean=0.4779521525, sdev=0.07189154625)
orib = OpenRepoInBrowser(open=visit_the_website)
filter = StreamFilter(Gate=Slider(0, range=0..3), Stream0=graph, Stream1=graph_2, Stream2=graph_3, Stream3=graph_4)
addition = Addition(A=random, B=filter)
larger = LargerThan(FirstNumber=addition, SecondNumber=0.5)  # -> LargerThan, OrEqualTo
cull = CullPattern(List=sqgrid.Points, CullPattern=larger.LargerThan)

# ==== cluster OpenRepoInBrowser
open = ClusterInput()
python = GhPythonScript(open=open)
# ---------- python: Python ----------
""" A simple 'open in browser' script """

import webbrowser

url = 'https://github.com/runxel/grasshopper-examples'

if open:
    webbrowser.open(url, new=2)
# ---------- end python ----------
