# Grasshopper definition ray-brep_intersection.ghx (Grasshopper 1.0.7)

number_of_rays_2 = Slider(30, range=0..100)
box = Box(graft([{Plane=PlaneXY(-5.631334183, -0.4877955436, 0), X=Domain(0, 4.544290616), Y=Domain(0, 4.544290616), Z=Domain(0, 12.67470986)}, {Plane=Plane(origin=(-0.2935959992, -7.989481639, 0), x=(0, 1, 0), y=(1, 0, 0)), X=Domain(0, 6.636106931), Y=Domain(0, 6.059054154), Z=Domain(-17.96102517, 0)}, {Plane=PlaneXY(2.735931078, 1.459757577, 0), X=Domain(0, 4.904948601), Y=Domain(0, 3.606579854), Z=Domain(0, 7.868968678)}]))
# Ray–BREP Intersection
# https://github.com/runxel/grasshopper-examples
pt = Point(Point(13.21546759, 0, 32.85565265))

# ---- group: Base Plane
plane = PlaneSrf(Plane=PlaneXY(0, 0, 0), XSize=Domain(-10, 10), YSize=Domain(-10, 10))

# ----
sdivide = DivideSurface(Surface=plane, UCount=number_of_rays_2, VCount=number_of_rays_2)  # -> Points, Normals, Parameters
ln = Line(PointA=pt, PointB=flatten(sdivide.Points))
visit_the_website = Button()
bcx = BrepCurve(BRep=box, Curve=ln)  # -> Curves, Points
orib = OpenRepoInBrowser(open=visit_the_website)
ln_2 = Line(PointA=pt, PointB=bcx.Points)
len = Length(Curve=ln_2)
null = NullItem(Item=len)  # -> NullFlags, InvalidFlags, Description
path_mapper = PathMapper(null.NullFlags, source="{A;B;C}", target="{C}")
mm = MassMultiplication(Input=path_mapper)  # -> Result, PartialResults
cull = CullPattern(List=graft(ln), CullPattern=mm.Result)

preview = CustomPreview(Geometry=box, Material=ColourSwatch(SwatchColor=RGB(255, 255, 255)))
preview_2 = CustomPreview(Geometry=plane, Material=ColourSwatch(SwatchColor=RGB(180, 80, 235)))
preview_3 = CustomPreview(Geometry=cull, Material=ColourSwatch(SwatchColor=RGBA(217, 170, 52, 150)))

# ==== cluster OpenRepoInBrowser
open = ClusterInput()
python = GhPythonScript(open=open)
# ---------- python: Python ----------
""" A simple 'open in browser' script """

import webbrowser

url = 'https://github.com/runxel/grasshopper-examples'

if open:
    webbrowser.open(url, new=2)
# ---------- end python ----------
