# Grasshopper definition rotate_by_length.ghx (Grasshopper 1.0.7)

# ----
# Rotate Lines based on Length
# https://github.com/runxel/grasshopper-examples
number_slider = Slider(20, range=2..30)
multiplicator = Slider(0.89, range=0.4..2.5)
total_distance = Slider(2, range=2..20)
multiplicator_2 = Slider(1.351, range=0..4)

series = Series(Start=0, Step=1, Count=number_slider)
series_2 = Series(Start=0, Step=1, Count=number_slider)
series_3 = Series(Start=0, Step=multiplicator, Count=number_slider)
visit_the_website = Button()
addition = Addition(A=series_3, B=total_distance)
pt = ConstructPoint(XCoordinate=0, YCoordinate=series, ZCoordinate=0)
orib = OpenRepoInBrowser(open=visit_the_website)
pow = Power(A=addition, B=multiplicator_2)
pt_2 = ConstructPoint(XCoordinate=pow, YCoordinate=reverse(series_2), ZCoordinate=0)  # -> reverse(Point)
ln = Line(StartPoint=pt, EndPoint=pt_2)
bnd = Bounds(Numbers=ln)
dom = ConstructDomain(DomainStart="0.5", DomainEnd="0")
remap = RemapNumbers(Value=ln, Source=bnd, Target=dom)  # -> Mapped, Clipped
xz = XZPlane(Origin=Point(0, 0, 0))
pi = Pi(Factor=remap.Mapped)
rotate = Rotate(Geometry=ln, Angle=pi, Plane=xz)  # -> Geometry, Transform
preview = CustomPreview(Geometry=ln, Shader=ColourSwatch(SwatchColor=RGB(153, 50, 50)))
preview_2 = CustomPreview(Geometry=rotate.Geometry, Shader=ColourSwatch(SwatchColor=RGB(20, 80, 97)))

# ==== cluster OpenRepoInBrowser
open = ClusterInput()
python = GhPythonScript(open=open)
# ---------- python: Python ----------
""" A simple 'open in browser' script """

import webbrowser

url = 'https://github.com/runxel/grasshopper-examples'

if open:
    webbrowser.open(url, new=2)
# ---------- end python ----------
