# Grasshopper definition round_to_nearest_increment.ghx (Grasshopper 1.0.7)

# Round to Nearest Increment
# https://github.com/runxel/grasshopper-examples
random = Random(Range=Domain(0, 100), Number=100, Seed=5)
round_to_nearest = ValueList({"1/16": 0.0625, "1/8": 0.125, "1/4": 0.25, "1/2": 0.5, "1", "2.5", "5", "10"}, selected="1/4")
numbers_after_dot = ValueList({"1": 10, "2": 100, "3": 1000, "4": 10000}, selected="2")
multiplication = Multiplication(A=random, B=numbers_after_dot)
round = RoundToIncrements(values=random, factor=round_to_nearest)
round_2 = Round(Number=multiplication)  # -> Nearest, Floor, Ceiling
before = Panel(random)
division = Division(A=round_2.Nearest, B=numbers_after_dot)
visit_the_website = Button()
after = Panel(round)
rounded = Panel(division)
orib = OpenRepoInBrowser(open=visit_the_website)

# ==== cluster RoundToIncrements: Round Number to nearst number on a multiplication table of factor
factor = ClusterInput()  # Rounding Factor
values = ClusterInput()  # Values to be Rounded
num = Number(values)
num_2 = Number(factor)
expression = Expression(x=num, y=num_2, Expression="y*Cint(x/y)")
num_3 = Number(expression)
rounded_values = ClusterOutput(num_3)

# ==== cluster OpenRepoInBrowser
open = ClusterInput()
python = GhPythonScript(open=open)
# ---------- python: Python ----------
""" A simple 'open in browser' script """

import webbrowser

url = 'https://github.com/runxel/grasshopper-examples'

if open:
    webbrowser.open(url, new=2)
# ---------- end python ----------
