# Grasshopper definition shell_roof.ghx (Grasshopper 1.0.7)

# Easy Shell Roof Structure with Bracing
# https://github.com/runxel/grasshopper-examples
base_srf = Surface(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)

subd_in_u = Slider(16, range=0..100)
subd_in_v = Slider(10, range=0..100)

preview = CustomPreview(Geometry=base_srf, Material=ColourSwatch(SwatchColor=RGBA(255, 106, 0, 80)))

range = Range(Domain=Domain(0, 1), Steps=subd_in_u)
range_2 = Range(Domain=Domain(0, 1), Steps=subd_in_v)
visit_the_website = Button()
pt = ConstructPoint(XCoordinate=range, YCoordinate=range_2, ZCoordinate=0)
dom² = ConstructDomain²(DomainU=Domain(0, 1), DomainV=Domain(0, 1))
iso = IsoCurve(Surface=reparameterize(base_srf), UVPoint=pt)  # -> UIsocurve, VIsocurve
divide = DivideDomain²(Domain=dom², UCount=subd_in_u, VCount=subd_in_v)
orib = OpenRepoInBrowser(open=visit_the_website)
offset = Slider(1.8, range=0.1..2)
subsrf = Isotrim(Surface=reparameterize(base_srf), Domain=divide)
crv = Curve(iso.UIsocurve)
crv_2 = Curve(iso.VIsocurve)
debrep = DeconstructBrep(Brep=subsrf)  # -> Faces, Edges, Vertices
Z = UnitZ(Factor=expr("-x", offset))
item = ListItem(List=debrep.Vertices, Index=0, Wrap=True)  # -> Item, Item1, Item2, Item3
ln = Line(StartPoint=item.Item, EndPoint=item.Item2)
ln_2 = Line(StartPoint=item.Item1, EndPoint=item.Item3)

extr = Extrude(Base=crv, Direction=Z)
extr_2 = Extrude(Base=crv_2, Direction=Z)
preview_2 = CustomPreview(Geometry=[extr, extr_2], Material=ColourSwatch(SwatchColor=RGBA(190, 26, 240, 129)))

move = Move(Geometry=[ln, ln_2], Motion=expr("x/2", Z))  # -> Geometry, Transform
pipe = Pipe(Curve=move.Geometry, Radius=Slider(0.08, range=0..0.1), Caps=0)

# ==== cluster OpenRepoInBrowser
open = ClusterInput()
python = GhPythonScript(open=open)
# ---------- python: Python ----------
""" A simple 'open in browser' script """

import webbrowser

url = 'https://github.com/runxel/grasshopper-examples'

if open:
    webbrowser.open(url, new=2)
# ---------- end python ----------
