# Grasshopper definition simple_triangulation.ghx (Grasshopper 1.0.7)

# Easy Triangulation of a Surface
# https://github.com/runxel/grasshopper-examples
crv = Curve(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)
crv_2 = Curve(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)
divide = Slider(7, range=1..20)
loft = Loft(Curves=[crv, crv_2], Options={Adjust=False, Closed=False, LoftEnds=0, LoftSimp=0, LoftType=0, Rebuild=10, Refit=0.01})
divide_2 = DivideDomain²(Domain=loft, UCount=divide, VCount=divide)
visit_the_website = Button()
subsrf = Isotrim(Surface=loft, Domain=divide_2)
orib = OpenRepoInBrowser(open=visit_the_website)
debrep = DeconstructBrep(Brep=subsrf)  # -> Faces, Edges, Vertices
lng = ListLength(List=debrep.Vertices)
item = ListItem(List=debrep.Vertices, Index=lng, Wrap=True)  # -> Item, Item1, Item2, Item3

srf4pt = _4PointSurface(CornerA=item.Item, CornerB=item.Item1, CornerC=item.Item2)
srf4pt_2 = _4PointSurface(CornerA=item.Item, CornerB=item.Item2, CornerC=item.Item3)

# ==== cluster OpenRepoInBrowser
open = ClusterInput()
python = GhPythonScript(open=open)
# ---------- python: Python ----------
""" A simple 'open in browser' script """

import webbrowser

url = 'https://github.com/runxel/grasshopper-examples'

if open:
    webbrowser.open(url, new=2)
# ---------- end python ----------
