# Grasshopper definition simple_zig_zag.ghx (Grasshopper 1.0.7)

# Simple Zig Zag
# https://github.com/runxel/grasshopper-examples
srf = Surface(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)
list = ValueList({"horizontal": 0, "vertikal": 1}, selected="horizontal")
sdivide = DivideSurface(Surface=srf, UCount=10, VCount=10)  # -> Points, Normals, Parameters

# ---- group: Flip from U to V
flip = FlipMatrix(Data=sdivide.Points)

# ----
visit_the_website = Button()
tstat = TreeStatistics(Tree=sdivide.Points)  # -> Paths, Length, Count
tstat_2 = TreeStatistics(Tree=flip)  # -> Paths, Length, Count

# ---- group: shift every second branch
# up/right
panel = Panel("""0
1""")
# down/left
panel_2 = Panel("""1
0""")
repeat = RepeatData(Data=panel, Length=tstat.Count)
repeat_2 = RepeatData(Data=panel_2, Length=tstat_2.Count)

# ----
orib = OpenRepoInBrowser(open=visit_the_website)
shift = ShiftList(List=sdivide.Points, Shift=graft(repeat), Wrap=False)
shift_2 = ShiftList(List=flip, Shift=graft(repeat_2), Wrap=False)

# ---- group: Flip to zig zag. Cull straight line
flip_2 = FlipMatrix(Data=shift)
flip_3 = FlipMatrix(Data=shift_2)
pline = PolyLine(Vertices=flip_2, Closed=False)  # -> flatten(Polyline)
pline_2 = PolyLine(Vertices=flip_3, Closed=False)  # -> flatten(Polyline)
rev = ReverseList(List=pline)
rev_2 = ReverseList(List=pline_2)
cull_i = CullIndex(List=rev, Indices=0, Wrap=True)
cull_i_2 = CullIndex(List=rev_2, Indices=0, Wrap=True)

# ----
filter = StreamFilter(Gate=list, Stream0=cull_i, Stream1=cull_i_2)
preview = CustomPreview(Geometry=filter, Shader=ColourSwatch(SwatchColor=RGB(255, 255, 255)))

# ==== cluster OpenRepoInBrowser
open = ClusterInput()
python = GhPythonScript(open=open)
# ---------- python: Python ----------
""" A simple 'open in browser' script """

import webbrowser

url = 'https://github.com/runxel/grasshopper-examples'

if open:
    webbrowser.open(url, new=2)
# ---------- end python ----------
