# Grasshopper definition spiral_panels.ghx (Grasshopper 1.0.7)

# ----
# Spiral Panels
# https://github.com/runxel/grasshopper-examples
# These sliders control the position of the four points that define the curve.
# These sliders determine the size of the field.
# These sliders determine the position of the disturbance point.
z1 = Slider(0, range=0..2)
z2 = Slider(0.3028, range=0..2)
z3 = Slider(0.9457, range=0..2)
z4 = Slider(1.6278, range=0..2)
x = Slider(0.5113, range=0.04..2)
depth = Slider(0.8255, range=0.04..2)
factor = Slider(0.4867, range=0.04..2)
x_2 = Slider(18.2399, range=-20..20)
y = Slider(-0.8911, range=-20..20)
z = Slider(0, range=-20..20)

multiplication = Multiplication(A=Slider(23, range=10..40), B=factor)
multiplication_2 = Multiplication(A=Slider(40, range=10..40), B=factor)
visit_the_website = Button()
orib = OpenRepoInBrowser(open=visit_the_website)
sqgrid = Square(Plane=PlaneXY(0, 0, 0), Size=factor, ExtentX=multiplication, ExtentY=multiplication_2)  # -> Cells, simplify(Points)
vec = VectorXYZ(XComponent=expr("-x", multiplication), YComponent=expr("-x", multiplication_2), ZComponent=0)  # -> Vector, Length
pt = PointXYZ(XComponent=0, YComponent=0, ZComponent=z1)
pt_2 = PointXYZ(XComponent=x, YComponent=0, ZComponent=z2)
pt_3 = PointXYZ(XComponent=x, YComponent=0, ZComponent=z3)
pt_4 = PointXYZ(XComponent=x, YComponent=0, ZComponent=z4)
move = Move(Geometry=sqgrid.Points, Motion=vec.Vector)  # -> Geometry, Transform
merge = Merge(Data1=pt, Data2=pt_2, Data3=pt_3, Data4=pt_4)
pt_5 = PointXYZ(XComponent=x_2, YComponent=y, ZComponent=z)
crv = Curve(Vertices=merge, Degree=3, Periodic=False)  # -> Curve, Length, Domain
Y = UnitY(Factor=depth)
symsim = SymbolSimple(Style=3, Size=12, Rotation=0, Colour=RGB(235, 84, 235))
symbol = SymbolDisplay(Location=pt_5, Display=symsim)
extr = Extrude(Base=crv.Curve, Direction=Y)
ln = Line(PointA=move.Geometry, PointB=pt_5)
# The move component multiplies the "leaf" (the extruded curve), creating one leaf for every cell of the grid.
move_2 = Move(Geometry=extr, Motion=move.Geometry)  # -> Geometry, Transform
len = Length(Curve=ln)
rot3d = Rotate3D(Geometry=move_2.Geometry, Angle=len, Center=Point(0, 0, 0), Axis=ln)  # -> Geometry, Transform

# ==== cluster OpenRepoInBrowser
open = ClusterInput()
python = GhPythonScript(open=open)
# ---------- python: Python ----------
""" A simple 'open in browser' script """

import webbrowser

url = 'https://github.com/runxel/grasshopper-examples'

if open:
    webbrowser.open(url, new=2)
# ---------- end python ----------
