# Grasshopper definition split_curve_into_regions.ghx (Grasshopper 1.0.7)

# Split Curve into Regions
# https://github.com/runxel/grasshopper-examples
three_curves = Curve([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])

# ---- group: Oval
oval_bounding_curve = Curve(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)

# ----
graft = GraftTree(Data=three_curves, IncludeEmptyLists=True, IncludeNullItems=True)
ccx = CurveCurve(CurveA=graft, CurveB=oval_bounding_curve)  # -> Points, ParamsA, ParamsB

visit_the_website = Button()
orib = OpenRepoInBrowser(open=visit_the_website)
shatter = Shatter(Curve=graft, Parameters=ccx.ParamsA)

# ---- group: Find midpoint of curve
eval = EvaluateCurve(Curve=reparameterize(shatter), Parameter="0.5")  # -> Point, Tangent, Angle

# ----
con = Containment(Point=eval.Point, Curve=oval_bounding_curve)  # -> Relationship, Point

equals = Equality(FirstNumber="2", SecondNumber=con.Relationship)  # -> Equality, Inequality

panel = Panel(con.Relationship)
panel_2 = Panel(equals.Equality)
dispatch = Dispatch(List=shatter, DispatchPattern=equals.Equality)  # -> ListA, ListB
outside_curves = Curve(dispatch.ListB)
inside_curves = Curve(dispatch.ListA)
entwine = Entwine(Branch00=inside_curves, Branch01=outside_curves, FlattenInputs=True)
entwine_2 = Entwine(
    Branch00=ColourSwatch(SwatchColor=RGB(139, 217, 72)),
    Branch01=ColourSwatch(SwatchColor=RGB(37, 156, 230)),
    FlattenInputs=True)
preview = CustomPreview(Geometry=entwine, Shader=entwine_2)
preview_2 = CustomPreview(Geometry=oval_bounding_curve, Shader=ColourSwatch(SwatchColor=RGB(222, 0, 115)))

# ==== cluster OpenRepoInBrowser
open = ClusterInput()
python = GhPythonScript(open=open)
# ---------- python: Python ----------
""" A simple 'open in browser' script """

import webbrowser

url = 'https://github.com/runxel/grasshopper-examples'

if open:
    webbrowser.open(url, new=2)
# ---------- end python ----------
