# Grasshopper definition star_curve_loft.ghx (Grasshopper 1.0.7)

# ---- group: Star shape generator
# Star Curve and Loft
# https://github.com/runxel/grasshopper-examples
sides = Slider(6, range=0..10)
offset = Slider(1.8, range=0..3)
cir = Circle(Plane=PlaneXY(0, 0, 0), Radius=3)
divide = DivideCurve(Curve=cir, Count=expr("x*2", sides), Kinks=False)  # -> Points, Tangents, Parameters
num = Number([0, 1])
long = LongestList(ListA=divide.Points, ListB=num, PaddingMode=4)  # -> ListA, ListB
multiplication = Multiplication(A=offset, B=long.ListB)
vec = Vector(divide.Points)
amp = Amplitude(Vector=vec, Amplitude=multiplication)
move = Move(Geometry=divide.Points, Motion=amp)  # -> Geometry, Transform
pline = PolyLine(Vertices=move.Geometry, Closed=True)

# ----
visit_the_website = Button()
orib = OpenRepoInBrowser(open=visit_the_website)

number_slider = Slider(8, range=0..100)
fillet = Fillet(Curve=pline, Radius=Slider(0.675, range=0..2))
series = Series(Start=0, Step=Slider(7, range=0..100), Count=number_slider)
Z = UnitZ(Factor=series)
series_2 = Series(Start=0, Step=Slider(8, range=0..10), Count=number_slider)
move_2 = Move(Geometry=fillet, Motion=Z)  # -> Geometry, Transform
rot3d = Rotate3D(Geometry=move_2.Geometry, Angle=series_2, Center=Point(0, 0, 0), Axis=Vector(0, 0, 1))  # -> Geometry, Transform
list = ValueList({"Normal": 0, "Loose": 1, "Tight": 2, "Straight": 3, "Uniform": 5}, selected="Loose")
loft_opt = LoftOptions(Closed=False, Adjust=Toggle(False), Rebuild=0, Refit=Slider(0, range=0..10), Type=list)
loft = Loft(Curves=rot3d.Geometry, Options=loft_opt)

# ==== cluster OpenRepoInBrowser
open = ClusterInput()
python = GhPythonScript(open=open)
# ---------- python: Python ----------
""" A simple 'open in browser' script """

import webbrowser

url = 'https://github.com/runxel/grasshopper-examples'

if open:
    webbrowser.open(url, new=2)
# ---------- end python ----------
