# Grasshopper definition tween_two_closed_curves_native.ghx (Grasshopper 1.0.7)

# Tween 2 Closed Curves
# https://github.com/runxel/grasshopper-examples
# Basically what Pufferfish's "Tween" does, with native components
degree = Slider(3, range=1..5)

# ---- group: Curve Left
crv = Curve(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)

# ---- group: Curve Right
crv_2 = Curve(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)

# ----
cp = ControlPoints(Curve=crv)  # -> Points, Weights, Knots
cp_2 = ControlPoints(Curve=crv_2)  # -> Points, Weights, Knots
lng = ListLength(List=cp.Points)
lng_2 = ListLength(List=cp_2.Points)
expression = Expression(x=lng, y=lng_2, Expression="If(x>y,x,y)")
visit_the_website = Button()

# ---- group: Curves need same ctrl pt structure
reb = RebuildCurve(Curve=crv, Degree=degree, Count=expression, Tangents=False)
reb_2 = RebuildCurve(Curve=crv_2, Degree=degree, Count=expression, Tangents=False)

# ----
orib = OpenRepoInBrowser(open=visit_the_website)
merge = Merge(Data1=reb, Data2=reb_2)

# ---- group: curves need seam at same position
pt = Point(Point(-49.43753931, 5.906880028, 0))
crv_cp = CurveClosestPoint(Point=pt, Curve=merge)  # -> Point, Parameter, Distance
seam = Seam(Curve=merge, Seam=crv_cp.Parameter)

# ----
tween_slider = Slider(0.67, range=0..1)

# ---- group: guide curve
crv_3 = Curve(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)

# ---- group: curves need same direction
flip = FlipCurve(Curve=seam, Guide=crv_3)  # -> Curve, Flag

# ----
dom = ConstructDomain(DomainStart=1, DomainEnd=0)
remap = RemapNumbers(Value=tween_slider, Source=Domain(0, 1), Target=dom)  # -> Mapped, Clipped
merge_2 = Merge(Data1=remap.Mapped, Data2=tween_slider)
ma = MassAddition(Input=merge_2)  # -> Result, PartialResults
division = Division(A=merge_2, B=ma.Result)

cp_3 = ControlPoints(Curve=flip.Curve)  # -> simplify(Points), Weights, Knots
multiplication = Multiplication(A=cp_3.Points, B=graft(division))
flip_2 = FlipMatrix(Data=multiplication)
ma_2 = MassAddition(Input=flip_2)  # -> Result, PartialResults
nurbs = NurbsCurve(Vertices=flatten(ma_2.Result), Degree=3, Periodic=True)  # -> Curve, Length, Domain

preview = CustomPreview(Geometry=nurbs.Curve, Material=ColourSwatch(SwatchColor=RGB(95, 227, 14)))

# ==== cluster OpenRepoInBrowser
open = ClusterInput()
python = GhPythonScript(open=open)
# ---------- python: Python ----------
""" A simple 'open in browser' script """

import webbrowser

url = 'https://github.com/runxel/grasshopper-examples'

if open:
    webbrowser.open(url, new=2)
# ---------- end python ----------
