# Grasshopper definition voronoi_on_surface.ghx (Grasshopper 1.0.7)

# Voronoi on Surface with Offset
# https://github.com/runxel/grasshopper-examples
srf = Surface(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)
# General Note: Most possibly it is much smarter to flatten (unroll) a given surface, make the adjustments, like Voronoi, then roll it back up on the BREP.
number_of_points = Slider(40, range=0..60)
visit_the_website = Button()
Y = Slider(29, range=0..60)
X = Slider(29, range=0..60)
Z = Slider(60, range=0..80)
area = Area(Geometry=srf)  # -> Area, Centroid
popgeo = PopulateGeometry(Geometry=srf, Count=number_of_points, Seed=1)
box = CenterBox(Base=area.Centroid, X=X, Y=Y, Z=Z)
voronoi³ = Voronoi3D(Points=popgeo, Box=box)  # -> Cells, Boundary
clean = CleanTree(Tree=voronoi³.Cells, CleanInvalid=True, CleanEmpty=False)
bbx = BrepBrep(BrepA=srf, BrepB=voronoi³.Cells)  # -> flatten(Curves), Points
dam = DataDam(DataA=clean, BufferDelay=10000000, BufferMode=0)

offset = DigitScroller(Scroller_Digits=12, Scroller_Prefix="offset", Scroller_Radix=9, Scroller_Value=-1)
# README: You can however use a scripting node to access RhinoScript and its methods directly which let us use Rhino's native Offset Brep command.
# 
# BEWARE!
# This component takes LOOOOONG!
boolean_toggle = BooleanToggle(True)
python = GhPythonScript(active=boolean_toggle, solid=dam, offset=offset)  # -> out, offsetbrep; inputs active: Boolean, solid: Brep
# ---------- python: Python ----------
"""
Can't be run in parallel to avoid race conditions which will lead 
to a crash of Rhino.

    Args:
        x: The x script variable
        y: The y script variable
    Retruns:
        a: The a output variable
"""

__author__ = "Lucas Becker"
__version__ = "2020-10-18"

import rhinoscriptsyntax as rs
import scriptcontext as sc
import Rhino.Geometry as rg
import Rhino


if active:
    
    geom = rs.coercegeometry(solid)
    sc.doc = Rhino.RhinoDoc.ActiveDoc
    
    rs.EnableRedraw(False)
    
    id = sc.doc.Objects.Add(geom)
    
    rs.UnselectAllObjects()
    rs.SelectObject(id, False)
    
    
    # OFFSET the BREP
    flip = "_FlipAll" if offset < 0 else ""
    script = "!_OffsetSrf _Solid=_Yes {} {} _Enter".format(flip, abs(offset))
    mru = "OffsetSrf"  # will be shown in the last of last executed commands
    Rhino.RhinoApp.RunScript(script, mru, False)
    
    
    # idea from https://github.com/stgeorges/rhinopython/blob/master/scripts/rhinoscript/selection.py#L56
    it = Rhino.DocObjects.ObjectEnumeratorSettings()
    e = sc.doc.Objects.GetObjectList(it).GetEnumerator()
    if not e.MoveNext():
        object = none
    object = e.Current
    #object.Select(True)
    brep = rs.coercegeometry(object)
    offsetbrep = brep
    
    sc.doc.Objects.Delete(id, True)
    sc.doc.Objects.Delete(object.Id, True)
    
    rs.EnableRedraw(True)
    
    sc.doc = ghdoc
# ---------- end python ----------
geo = Geometry(python.offsetbrep)

# ----
# README: There is the "Offset on Surface" component, but it has a bug (?), where the offset direction is logically flipped and you would need to decide to choose direction per curve.
# Also the component can only offset curves with round caps (i.e. no sharp corners).
# README: "Offset Surface" can't offset BREPs.
# 
# Pufferfish's "Offset Surface" *can* offset BREPs – as long they aren't closed...
number_slider = Slider(0.8, range=0..1)  # disabled
offset_2 = OffsetSurface(Surface=voronoi³.Cells, Distance=0, Retrim=True)  # disabled
offsets = OffsetOnSrf(Curve=bbx.Curves, Distance=number_slider, Surface=srf)  # disabled
offset_3 = DigitScroller(Scroller_Digits=12, Scroller_Prefix="offset", Scroller_Radix=9, Scroller_Value=-3)
bbx_2 = BrepBrep(BrepA=srf, BrepB=geo)  # -> flatten(Curves), Points
offset_4 = OffsetSurface(Surface=srf, Distance=offset_3, Retrim=True)
preview = CustomPreview(Geometry=bbx_2.Curves, Material=ColourSwatch(SwatchColor=RGB(255, 255, 255)))
bbox = BoundingBox(Content=offset_4, Plane=PlaneXY(0, 0, 0))  # -> Box, Box_2
debrep = DeconstructBrep(Brep=bbox.Box)  # -> Faces, Edges, Vertices
area_2 = Area(Geometry=debrep.Faces)  # -> Area, Centroid
pdecon = Deconstruct(Point=area_2.Centroid)  # -> XComponent, YComponent, ZComponent
sort = SortList(Keys=pdecon.ZComponent, ValuesA=debrep.Faces, ValuesB=area_2.Centroid)  # -> Keys, ValuesA, ValuesB
item = ListItem(List=sort.ValuesA, Index=0, Wrap=True)
item_2 = ListItem(List=sort.ValuesA, Index=-1, Wrap=True)
item_3 = ListItem(List=sort.ValuesB, Index=0, Wrap=True)
item_4 = ListItem(List=sort.ValuesB, Index=-1, Wrap=True)
merge = Merge(Data1=item_3, Data2=item_4)  # -> graft(Result)
merge_2 = Merge(Data1=item, Data2=item_2)  # -> graft(Result)
scale = Scale(Geometry=merge_2, Center=merge, Factor=Slider(1.5, range=0..10))  # -> Geometry, Transform
bbx_3 = BrepBrep(BrepA=offset_4, BrepB=scale.Geometry)  # -> Curves, Points
bbx_4 = BrepBrep(BrepA=srf, BrepB=scale.Geometry)  # -> Curves, Points
boundary = BoundarySurfaces(Edges=[bbx_3.Curves, bbx_4.Curves])
# If your RhinoDoc tolerance settings
# are too low (e.g. 0.0001) the BREP Join
# might fail. Higher the tolerance then.
merge_3 = Merge(Data1=offset_4, Data2=srf, Data3=boundary)  # -> flatten(Result)
join = BrepJoin(Breps=merge_3)  # -> Breps, Closed
dam_2 = DataDam(DataA=geo, BufferDelay=10000000, BufferMode=0)
sdiff = SolidDifference(BrepsA=join.Breps, BrepsB=dam_2)
move = Move(Geometry=sdiff, Motion=Vector(123.7520183, 0, 0))  # -> Geometry, Transform
